# Grasshopper definition 32-simple-bridge-reticolare-curvo.ghx (Grasshopper 1.0.8)
# plug-ins: BridGHe

# PROCEDURA: 32 | SIMPLE BRIDGE RETICOLARE | CURVO R=250 m
# Geometria in mm: campate 30+40+30 m, tre travi a -4/0/+4 m, soletta 12 m x 250 mm.
# Modifica i pannelli: appoggi, interassi, quote, conci, traversi, passo soletta. Nessun carico o analisi.
# Il concio 24-36 m attraversa la pila a 30 m. Il giunto aggiuntivo a 18 m interessa solo G2.
# Members + Member IDs hanno gli stessi percorsi. Famiglie: 0 travi, 1 traversi pieni, 2/3 correnti, 4 montanti, 5 diagonali.
# Deck Beams: soletta a metà spessore; Deck Connections -> Bridge Connections mode 0 per link rigidi.
# Grillage Geometry include la famiglia 8: assegnare esplicitamente una proprietà cls. Bridge Geometry mantiene la sola carpenteria.
tracciato_3d_mm = Curve(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)
coppie_progressiva_pendenza = Number(Tree({0}: [0, -2], {1}: [50000, 2], {2}: [100000, 3]))
giunti_mm_0_comuni_2_solo_g2 = Number(Tree({0}: [12000, 24000, 36000, 48000, 60000, 72000, 84000], {2}: [18000]))
segments = BridgeSegments(Joints=giunti_mm_0_comuni_2_solo_g2, MaximumLength=12000)
passo_traversi_mm = Panel("5000")
altezza_reticolo_mm = Panel("1500")
diaphragms = BridgeDiaphragms(
    MaximumSpacing=passo_traversi_mm,
    AtSupports=True,
    TrussHeight=altezza_reticolo_mm,
    PanelsPerBay=2,
    Pattern=2,
    ConnectX=False)
progressive_appoggi_mm = Panel("""0
30000
70000
100000""")
offsets_travi_mm = Panel("""-4000
0
4000""")
quote_assi_mm = Panel("-1500")
larghezze_sx_dx_mm = Panel("""6000
6000""")
spessore_soletta_mm = Panel("250")
lunghezza_massima_mm = Panel("2500")
errore_di_corda_mm = Panel("5")
sghembi_appoggi_deg = Panel("""0
12
-8
0""")
passo_soletta_mm = Panel("2000")
bridgetruss = SimpleBridgeTrussDiaphragms(
    Alignment=tracciato_3d_mm,
    SupportStations=progressive_appoggi_mm,
    GirderOffsets=offsets_travi_mm,
    GirderLevels=quote_assi_mm,
    DeckWidths=larghezze_sx_dx_mm,
    DeckThickness=spessore_soletta_mm,
    Crossfall=coppie_progressiva_pendenza,
    Segments=segments,
    Diaphragms=diaphragms,
    MaximumElementLength=lunghezza_massima_mm,
    ChordTolerance=errore_di_corda_mm,
    SupportSkew=sghembi_appoggi_deg,
    Labels=False,
    DeckBeamSpacing=passo_soletta_mm)  # -> Members, MemberIDs, Longitudinals, DiaphragmMembers, Nodes, SupportPoints, JointPoints, Deck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
connections = BridgeConnections(Mode=0, Connections=flatten(bridgetruss.DeckConnections), Offset=Vector(0, 0, 0))  # -> Elements, Information
informazioni = Panel(bridgetruss.Information)
conci_girder_segment_start_end = Panel(bridgetruss.SegmentRanges)
topologia_degli_assi = Panel(bridgetruss.Topology)
larghezze_tributarie_soletta_mm = Panel(bridgetruss.DeckStripWidths)
