# Grasshopper definition 34-sezioni-per-progressiva.ghx (Grasshopper 1.0.8)
# plug-ins: BridGHe

support_stations = Panel("""0
30000
70000
100000""")
girder_offsets = Panel("""-4000
0
4000""")
# 34 | SEZIONI PER PROGRESSIVA: 34 | SEZIONI PER PROGRESSIVA
# Trave centrale G2: cambio sezione fra 12.345 e 45 m, rastremazione verticale 1→1.2.
# La regola divide le aste alle sue estremità e conserva l'identità del concio.
# Unità N, mm, MPa. Nessuna analisi Straus avviata. Procedura e controlli nel README della cartella.
tracciato_100_m = Curve(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)
segments = BridgeSegments(Joints=[12000, 24000, 36000, 48000, 60000, 72000, 84000], MaximumLength=12000)
bridgesolid = SimpleBridgeSolidDiaphragms(
    Alignment=tracciato_100_m,
    SupportStations=support_stations,
    GirderOffsets=girder_offsets,
    GirderLevels=-1500,
    DeckWidths=6000,
    DeckThickness=250,
    Segments=segments,
    MaximumElementLength=2500,
    ChordTolerance=5,
    SupportSkew=0,
    Labels=False,
    DeckBeamSpacing=0)  # -> Members, MemberIDs, Longitudinals, DiaphragmMembers, Nodes, SupportPoints, JointPoints, Deck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
start = Panel("12345")
end = Panel("45000")
proprietà_rastremata = Data(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)
sectionschedule = BridgeSectionSchedule(
    Property=proprietà_rastremata,
    Start=start,
    End=end,
    Family=0,
    Group=2,
    Segment=0,
    StartScale=Vector(1, 1, 0),
    EndScale=Vector(1, 1.2, 0))
proprietà_acciaio_n_mm_sostituibile = Data(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)
assignbridge = BridgeMemberAssignment(
    BridgeGeometry=bridgesolid.BridgeGeometry,
    DefaultProperties=proprietà_acciaio_n_mm_sostituibile,
    Families=-1,
    Schedule=sectionschedule)  # -> Beams, PhysicalIDs, Unassigned, Information
information = Panel(assignbridge.Information)
