# Grasshopper definition 35-assegnazione-membri.ghx (Grasshopper 1.0.8)
# plug-ins: BridGHe

support_stations = Panel("""0
30000
70000
100000""")
girder_offsets = Panel("""-4000
0
4000""")
# 35 | ASSEGNAZIONE MEMBRI: 35 | ASSEGNAZIONE MEMBRI
# Ponte curvo a tre travi, conci indipendenti dalle campate.
# Gli ID FEM sono numerici; Physical IDs e gruppi conservano famiglia/trave/concio. Le proprietà sono dimostrative.
# Unità N, mm, MPa. Nessuna analisi Straus avviata. Procedura e controlli nel README della cartella.
tracciato_r_250_m = Curve(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)
segments = BridgeSegments(Joints=[12000, 24000, 36000, 48000, 60000, 72000, 84000], MaximumLength=12000)
bridgesolid = SimpleBridgeSolidDiaphragms(
    Alignment=tracciato_r_250_m,
    SupportStations=support_stations,
    GirderOffsets=girder_offsets,
    GirderLevels=-1500,
    DeckWidths=6000,
    DeckThickness=250,
    Segments=segments,
    MaximumElementLength=2500,
    ChordTolerance=5,
    SupportSkew=0,
    Labels=False,
    DeckBeamSpacing=0)  # -> Members, MemberIDs, Longitudinals, DiaphragmMembers, Nodes, SupportPoints, JointPoints, Deck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
proprietà_acciaio_n_mm_sostituibile = Data(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)
assignbridge = BridgeMemberAssignment(BridgeGeometry=bridgesolid.BridgeGeometry, DefaultProperties=proprietà_acciaio_n_mm_sostituibile, Families=-1)  # -> Beams, PhysicalIDs, Unassigned, Information
physical_ids = Panel(assignbridge.PhysicalIDs)
information = Panel(assignbridge.Information)
