# Grasshopper definition 36-appoggi-orientati.ghx (Grasshopper 1.0.8)
# plug-ins: BridGHe

support_stations = Panel("""0
30000
70000
100000""")
girder_offsets = Panel("""-4000
0
4000""")
# 36 | APPOGGI: 36 | APPOGGI
# Dodici appoggi: tre travi per quattro allineamenti. Centro prima spalla fisso, guide longitudinali al centro delle altre linee.
# Gli appoggi esterni sono multidirezionali; le rotazioni sono libere. La preview mostra gli assi effettivi dei vincoli.
# Unità N, mm, MPa. Nessuna analisi Straus avviata. Procedura e controlli nel README della cartella.
tracciato_r_250_m = Curve(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)
segments = BridgeSegments(Joints=[12000, 24000, 36000, 48000, 60000, 72000, 84000], MaximumLength=12000)
bridgesolid = SimpleBridgeSolidDiaphragms(
    Alignment=tracciato_r_250_m,
    SupportStations=support_stations,
    GirderOffsets=girder_offsets,
    GirderLevels=-1500,
    DeckWidths=6000,
    DeckThickness=250,
    Segments=segments,
    MaximumElementLength=2500,
    ChordTolerance=5,
    SupportSkew=0,
    Labels=False,
    DeckBeamSpacing=0)  # -> Members, MemberIDs, Longitudinals, DiaphragmMembers, Nodes, SupportPoints, JointPoints, Deck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
bearings = BridgeBearings(
    BridgeGeometry=bridgesolid.BridgeGeometry,
    Types=[2, 0, 2, 2, 1, 2, 2, 1, 2, 2, 1, 2],
    GuideAngle=0,
    TranslationStiffness=Vector(0, 0, 0),
    RotationStiffness=Vector(0, 0, 0))  # -> Nodes, Frames, Labels
labels = Panel(bearings.Labels)
