# Grasshopper definition 37-connessioni-offset.ghx (Grasshopper 1.0.8)
# plug-ins: BridGHe

# 37 | CONNESSIONI: 37 | CONNESSIONI
# Tre rappresentazioni distinte: link rigido Straus, asta deformabile con proprietà, offset locale della sezione.
# I link non sono travi con rigidezza artificiosamente grande. Le linee vanno collegate ai vertici FEM previsti.
# Unità N, mm, MPa. Nessuna analisi Straus avviata. Procedura e controlli nel README della cartella.
asta_elastica_proprietà_esplicita = Data(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)
trave_da_spostare = Data(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)
mode_0 = BridgeConnections(Mode=0, Connections=[Line((0, 0, -1500), (0, 0, -125)), Line((5000, 0, -1500), (5000, 0, -125))], Offset=Vector(0, 0, 0))  # -> Elements, Information
mode_1 = BridgeConnections(
    Mode=1,
    Connections=[Line((0, 0, -1500), (0, 0, -125)), Line((5000, 0, -1500), (5000, 0, -125))],
    Property=asta_elastica_proprietà_esplicita,
    Offset=Vector(0, 0, 0))  # -> Elements, Information
mode_2 = BridgeConnections(Mode=2, Beams=trave_da_spostare, Offset=Vector(0, 100, 0))  # -> Elements, Information
information = Panel(mode_0.Information)
information_2 = Panel(mode_1.Information)
information_3 = Panel(mode_2.Information)
