# Grasshopper definition 38-controventi-longitudinali.ghx (Grasshopper 1.0.8)
# plug-ins: BridGHe

support_stations = Panel("""0
30000
70000
100000""")
girder_offsets = Panel("""-4000
0
4000""")
# 38 | CONTROVENTI LONGITUDINALI: 38 | CONTROVENTI LONGITUDINALI
# Controventi X fra 0, 12.345 e 30 m, nelle due maglie trasversali. Le aste delle travi vengono divise agli attacchi.
# Pattern 0/1/2: X, V, Warren. Cambiare Normal Offset genera i montanti di collegamento.
# Unità N, mm, MPa. Nessuna analisi Straus avviata. Procedura e controlli nel README della cartella.
tracciato_100_m = Curve(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)
segments = BridgeSegments(Joints=[12000, 24000, 36000, 48000, 60000, 72000, 84000], MaximumLength=12000)
bridgesolid = SimpleBridgeSolidDiaphragms(
    Alignment=tracciato_100_m,
    SupportStations=support_stations,
    GirderOffsets=girder_offsets,
    GirderLevels=-1500,
    DeckWidths=6000,
    DeckThickness=250,
    Segments=segments,
    MaximumElementLength=2500,
    ChordTolerance=5,
    SupportSkew=0,
    Labels=False,
    DeckBeamSpacing=0)  # -> Members, MemberIDs, Longitudinals, DiaphragmMembers, Nodes, SupportPoints, JointPoints, Deck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
stations = Panel("""0
12345
30000""")
longbracing = BridgeLongitudinalBracing(BridgeGeometry=bridgesolid.BridgeGeometry, Stations=stations, Pattern=0, NormalOffset=0, ConnectX=False)  # -> BridgeGeometry, AddedMembers, Information
information = Panel(longbracing.Information)
proprietà_acciaio_n_mm_sostituibile = Data(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)
assignbridge = BridgeMemberAssignment(BridgeGeometry=longbracing.BridgeGeometry, DefaultProperties=proprietà_acciaio_n_mm_sostituibile, Families=-1)  # -> Beams, PhysicalIDs, Unassigned, Information
information_2 = Panel(assignbridge.Information)
