# Grasshopper definition 39-soletta-getti.ghx (Grasshopper 1.0.8)
# plug-ins: BridGHe

support_stations = Panel("""0
30000
70000
100000""")
girder_offsets = Panel("""-4000
0
4000""")
# 39 | MESH SOLETTA: 39 | MESH SOLETTA
# Ponte curvo con plate triangolari sulla superficie media e tre zone di getto.
# Usare BG in uscita per assegnare le travi. Connection Lines definisce collegamenti da creare esplicitamente con Bridge Connections.
# Unità N, mm, MPa. Nessuna analisi Straus avviata. Procedura e controlli nel README della cartella.
tracciato_r_250_m = Curve(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)
segments = BridgeSegments(Joints=[12000, 24000, 36000, 48000, 60000, 72000, 84000], MaximumLength=12000)
bridgesolid = SimpleBridgeSolidDiaphragms(
    Alignment=tracciato_r_250_m,
    SupportStations=support_stations,
    GirderOffsets=girder_offsets,
    GirderLevels=-1500,
    DeckWidths=6000,
    DeckThickness=250,
    Segments=segments,
    MaximumElementLength=2500,
    ChordTolerance=5,
    SupportSkew=0,
    Labels=False,
    DeckBeamSpacing=0)  # -> Members, MemberIDs, Longitudinals, DiaphragmMembers, Nodes, SupportPoints, JointPoints, Deck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
pour_boundaries = Panel("""30000
70000""")
shell_c_t_250_mm_e_34000_mpa = Data(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)
deckmesh = BridgeDeckMesh(
    BridgeGeometry=bridgesolid.BridgeGeometry,
    PlateProperty=shell_c_t_250_mm_e_34000_mpa,
    LongitudinalMeshLength=5000,
    TransverseMeshLength=3000,
    PourBoundaries=pour_boundaries,
    Triangles=True)  # -> BridgeGeometry, Mesh, Plates, ConnectionLines, Stations, Information
information = Panel(deckmesh.Information)
proprietà_acciaio_n_mm_sostituibile = Data(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)
assignbridge = BridgeMemberAssignment(BridgeGeometry=deckmesh.BridgeGeometry, DefaultProperties=proprietà_acciaio_n_mm_sostituibile, Families=-1)  # -> Beams, PhysicalIDs, Unassigned, Information
