# Grasshopper definition 40-sequenza-costruttiva.ghx (Grasshopper 1.0.8)
# plug-ins: BridGHe

support_stations = Panel("""0
30000
70000
100000""")
girder_offsets = Panel("""-4000
0
4000""")
# 40 | SEQUENZA COSTRUTTIVA: 40 | SEQUENZA COSTRUTTIVA
# Tre snapshot indipendenti: primo concio G2, trave G2 completa, struttura intera.
# Fasi 10/20/30 ai giorni 0/7/28. Nessun trasferimento automatico di deformazioni o storia dal modello precedente.
# Unità N, mm, MPa. Nessuna analisi Straus avviata. Procedura e controlli nel README della cartella.
tracciato_100_m = Curve(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)
segments = BridgeSegments(Joints=[12000, 24000, 36000, 48000, 60000, 72000, 84000], MaximumLength=12000)
bridgesolid = SimpleBridgeSolidDiaphragms(
    Alignment=tracciato_100_m,
    SupportStations=support_stations,
    GirderOffsets=girder_offsets,
    GirderLevels=-1500,
    DeckWidths=6000,
    DeckThickness=250,
    Segments=segments,
    MaximumElementLength=2500,
    ChordTolerance=5,
    SupportSkew=0,
    Labels=False,
    DeckBeamSpacing=0)  # -> Members, MemberIDs, Longitudinals, DiaphragmMembers, Nodes, SupportPoints, JointPoints, Deck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
proprietà_acciaio_n_mm_sostituibile = Data(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)
assignbridge = BridgeMemberAssignment(BridgeGeometry=bridgesolid.BridgeGeometry, DefaultProperties=proprietà_acciaio_n_mm_sostituibile, Families=-1)  # -> Beams, PhysicalIDs, Unassigned, Information
bm = BuildModel(Elements=assignbridge.Beams, Name="Sequenza geometrica", Units=2)
phase = BridgePhase(Number=10, Name="Primo concio G2", SectionState=1, Day=0)
phase_2 = BridgePhase(Number=20, Name="Trave G2", SectionState=1, Day=7)
phase_3 = BridgePhase(Number=30, Name="Struttura completa", SectionState=1, Day=28)
construction = BridgeConstructionSequence(Model=bm, Phase=phase, PhysicalIDs="Girder:2:1", ActiveBearingIDs="*", EnableBearings=True)  # -> PhaseModel, NativeStage, Phase, ActivePhysicalIDs, AvailableGroups, Information
construction_2 = BridgeConstructionSequence(Model=bm, Phase=phase_2, ActiveGroups="Girder\Group2", ActiveBearingIDs="*", EnableBearings=True)  # -> PhaseModel, NativeStage, Phase, ActivePhysicalIDs, AvailableGroups, Information
construction_3 = BridgeConstructionSequence(Model=bm, Phase=phase_3, ActiveBearingIDs="*", EnableBearings=True)  # -> PhaseModel, NativeStage, Phase, ActivePhysicalIDs, AvailableGroups, Information
information = Panel(construction.Information)
information_2 = Panel(construction_2.Information)
information_3 = Panel(construction_3.Information)
