# Grasshopper definition 41-pioli-irrigidimenti.ghx (Grasshopper 1.0.8)
# plug-ins: BridGHe

support_stations = Panel("""0
30000
70000
100000""")
girder_offsets = Panel("""-4000
0
4000""")
# 41 | PIOLI E IRRIGIDIMENTI: 41 | PIOLI E IRRIGIDIMENTI
# Trave G2, intervallo [0,10 m): 50 file da due pioli e tre coppie di irrigidimenti.
# Geometria e quantità da classi gPC. Sono dettagli di officina, non elementi FEM o verifiche resistenti.
# Unità N, mm, MPa. Nessuna analisi Straus avviata. Procedura e controlli nel README della cartella.
tracciato_100_m = Curve(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)
segments = BridgeSegments(Joints=[12000, 24000, 36000, 48000, 60000, 72000, 84000], MaximumLength=12000)
bridgesolid = SimpleBridgeSolidDiaphragms(
    Alignment=tracciato_100_m,
    SupportStations=support_stations,
    GirderOffsets=girder_offsets,
    GirderLevels=-1500,
    DeckWidths=6000,
    DeckThickness=250,
    Segments=segments,
    MaximumElementLength=2500,
    ChordTolerance=5,
    SupportSkew=0,
    Labels=False,
    DeckBeamSpacing=0)  # -> Members, MemberIDs, Longitudinals, DiaphragmMembers, Nodes, SupportPoints, JointPoints, Deck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
start = Panel("0")
end = Panel("10000")
gpc_irrigidimenti_200x20 = Data({Data="{\"Enabled\":true,\"LeftPanel\":0,\"RightPanel\":0,\"EqualPanels\":false,\"ExternalCompressionKN\":0,\"LoadX\":0,\"Layout\":0,\"LayoutName\":\"Bilaterali simmetrici\",\"Width\":200,\"Thickness\":20,\"RightWidth\":250,\"RightThickness\":25,\"LengthFactor\":1,\"CheckWelds\":false,\"WeldThroat\":0}", Kind="BridgeIntermediateStiffener"})
gpc_pioli_ø22_h180_passo200 = Data({Data="{\"Enabled\":true,\"CountPerRow\":2,\"Diameter\":22,\"Height\":180,\"LongitudinalPitch\":200,\"TransversePitch\":150,\"Fu\":0,\"GammaV\":0,\"HeadDiameter\":35,\"HeadThickness\":10,\"RepeatedActionDetail\":false,\"RequiredCover\":40}", Kind="BridgeStudOptions"})
h_gpc_1330_16_ali_450_30_e_600_40 = Data({Data="{\"SlabWidth\":2200,\"SlabHeight\":250,\"WebHeight\":1330,\"WebThickness\":16,\"TopWidth\":450,\"TopThickness\":30,\"BottomWidth\":600,\"BottomThickness\":40,\"SecondBottomWidth\":0,\"SecondBottomThickness\":0,\"SecondBottomEnabled\":false,\"SectionType\":0,\"WebOffset\":0,\"WebSpacing\":0}", Kind="HSectionDimensions"})
detaillayout = BridgeDetailLayout(
    BridgeGeometry=bridgesolid.BridgeGeometry,
    SectionGeometry=h_gpc_1330_16_ali_450_30_e_600_40,
    Girders=2,
    Start=start,
    End=end,
    SteelTopOffset=1250,
    Studs=gpc_pioli_ø22_h180_passo200,
    IntermediateStiffener=gpc_irrigidimenti_200x20,
    StiffenerPitch=4000)  # -> StudAxes, StudHeads, StiffenerPlates, Details, IDs, Stations, Information
information = Panel(detaillayout.Information)
