# Grasshopper definition 44-mappa-verifiche.ghx (Grasshopper 1.0.8)
# plug-ins: BridGHe

support_stations = Panel("""0
30000
70000
100000""")
girder_offsets = Panel("""-4000
0
4000""")
# 44 | MAPPA VERIFICHE: 44 | MAPPA VERIFICHE
# Controlli locali gPC su una sezione di esempio, con azioni assegnate direttamente: nessuna soluzione FEM globale.
# Solo l'asta 1 riceve controlli. Tutte le altre restano grigie: non sono verificate.
# Unità N, mm, MPa. Nessuna analisi Straus avviata. Procedura e controlli nel README della cartella.
tracciato_100_m = Curve(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)
geometry = BridgeSectionGeometry(
    SlabWidth=2200,
    SlabHeight=250,
    WebHeight=1330,
    WebThickness=16,
    TopWidth=450,
    TopThickness=30,
    BottomWidth=600,
    BottomThickness=40,
    SecondBottomEnabled=False,
    SecondBottomWidth=600,
    SecondBottomThickness=20,
    SectionType=0,
    WebOffset=0,
    WebSpacing=1800)
studs = BridgeStuds(
    Enabled=True,
    CountPerRow=2,
    Diameter=22,
    Height=180,
    LongitudinalPitch=200,
    TransversePitch=150,
    Fu=450,
    GammaV=1.25,
    HeadDiameter=35,
    HeadThickness=10,
    RequiredCover=40,
    RepeatedActionDetail=True)
segments = BridgeSegments(Joints=[12000, 24000, 36000, 48000, 60000, 72000, 84000], MaximumLength=12000)
bridgesolid = SimpleBridgeSolidDiaphragms(
    Alignment=tracciato_100_m,
    SupportStations=support_stations,
    GirderOffsets=girder_offsets,
    GirderLevels=-1500,
    DeckWidths=6000,
    DeckThickness=250,
    Segments=segments,
    MaximumElementLength=2500,
    ChordTolerance=5,
    SupportSkew=0,
    Labels=False,
    DeckBeamSpacing=0)  # -> Members, MemberIDs, Longitudinals, DiaphragmMembers, Nodes, SupportPoints, JointPoints, Deck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
proprietà_acciaio_n_mm_sostituibile = Data(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)
incrementi_locali_dimostrativi = Data([{Data="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", Kind="BridgePhase"}, {Data="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", Kind="BridgePhase"}])
s355 = Data(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)
c30 = Data(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)
assignbridge = BridgeMemberAssignment(BridgeGeometry=bridgesolid.BridgeGeometry, DefaultProperties=proprietà_acciaio_n_mm_sostituibile, Families=-1)  # -> Beams, PhysicalIDs, Unassigned, Information
bridgecheck = BridgeSectionCheck(Geometry=geometry, Concrete=c30, Steel=s355, Phases=incrementi_locali_dimostrativi, Details=studs)  # -> Results, Phases, Warnings, NativeAnalysis
bm = BuildModel(Elements=assignbridge.Beams, Units=2)
checkmap = BridgeCheckMap(Model=bm, Results=bridgecheck.Results, BeamIDs=["1", "1"], Stations=[0, 0], Cases=["Demo-G1", "Demo-G2"], Labels=False)  # -> Axes, Colours, BeamIDs, MaximumRatios, Unavailable, Governing, Information
governing = Panel(checkmap.Governing)
information = Panel(checkmap.Information)
