# Grasshopper definition 45-ponte-completo-fasi.ghx (Grasshopper 1.0.8)
# plug-ins: BridGHe

support_stations = Panel("""0
30000
70000
100000""")
girder_offsets = Panel("""-4000
0
4000""")
# 45 | PONTE COMPLETO: GEOMETRIA → MODELLO → FASI: 45 | PONTE COMPLETO: GEOMETRIA → MODELLO → FASI
# Ponte curvo 30+40+30 m, tre travi, conci da 12 m, controventi Warren, soletta shell in tre getti, link rigidi e appoggi orientati.
# Tre snapshot: acciaio, primo getto, soletta completa. Modello senza carichi: proprietà e schema da dimensionare. Non è una verifica del ponte.
# Unità N, mm, MPa. Nessuna analisi Straus avviata. Procedura e controlli nel README della cartella.
tracciato_r_250_m = Curve(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)
segments = BridgeSegments(Joints=[12000, 24000, 36000, 48000, 60000, 72000, 84000], MaximumLength=12000)
bridgesolid = SimpleBridgeSolidDiaphragms(
    Alignment=tracciato_r_250_m,
    SupportStations=support_stations,
    GirderOffsets=girder_offsets,
    GirderLevels=-1500,
    DeckWidths=6000,
    DeckThickness=250,
    Segments=segments,
    MaximumElementLength=2500,
    ChordTolerance=5,
    SupportSkew=0,
    Labels=False,
    DeckBeamSpacing=0)  # -> Members, MemberIDs, Longitudinals, DiaphragmMembers, Nodes, SupportPoints, JointPoints, Deck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
stations = Panel("""0
10000
20000
30000
40000
50000
60000
70000
80000
90000
100000""")
longbracing = BridgeLongitudinalBracing(BridgeGeometry=bridgesolid.BridgeGeometry, Stations=stations, Pattern=2, NormalOffset=0, ConnectX=False)  # -> BridgeGeometry, AddedMembers, Information
pour_boundaries = Panel("""30000
70000""")
shell_c_t_250_mm_e_34000_mpa = Data(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)
deckmesh = BridgeDeckMesh(
    BridgeGeometry=longbracing.BridgeGeometry,
    PlateProperty=shell_c_t_250_mm_e_34000_mpa,
    LongitudinalMeshLength=5000,
    TransverseMeshLength=3000,
    PourBoundaries=pour_boundaries,
    Triangles=True)  # -> BridgeGeometry, Mesh, Plates, ConnectionLines, Stations, Information
proprietà_acciaio_n_mm_sostituibile = Data(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)
assignbridge = BridgeMemberAssignment(BridgeGeometry=deckmesh.BridgeGeometry, DefaultProperties=proprietà_acciaio_n_mm_sostituibile, Families=-1)  # -> Beams, PhysicalIDs, Unassigned, Information
bearings = BridgeBearings(
    BridgeGeometry=deckmesh.BridgeGeometry,
    Types=[2, 0, 2, 2, 1, 2, 2, 1, 2, 2, 1, 2],
    GuideAngle=0,
    TranslationStiffness=Vector(0, 0, 0),
    RotationStiffness=Vector(0, 0, 0))  # -> Nodes, Frames, Labels
connections = BridgeConnections(Mode=0, Connections=deckmesh.ConnectionLines, Offset=Vector(0, 0, 0))  # -> Elements, Information
bm = BuildModel(
    Elements=flatten([assignbridge.Beams, deckmesh.Plates, bearings.Nodes, connections.Elements]),
    Name="Ponte curvo acciaio-shell 30+40+30",
    Units=2)
phase = BridgePhase(Number=10, Name="Acciaio", SectionState=0, Day=0)
phase_2 = BridgePhase(Number=20, Name="Primo getto attivo", SectionState=1, Day=7)
phase_3 = BridgePhase(Number=30, Name="Soletta completa", SectionState=1, Day=28)
construction = BridgeConstructionSequence(
    Model=bm,
    Phase=phase,
    ActiveGroups=["Girder", "SolidDiaphragm", "LongitudinalBracing"],
    ActiveBearingIDs="*",
    EnableBearings=True)  # -> PhaseModel, NativeStage, Phase, ActivePhysicalIDs, AvailableGroups, Information
construction_2 = BridgeConstructionSequence(
    Model=bm,
    Phase=phase_2,
    ActiveGroups=["Girder", "SolidDiaphragm", "LongitudinalBracing", "Deck\Pour1"],
    ActiveBearingIDs="*",
    EnableBearings=True)  # -> PhaseModel, NativeStage, Phase, ActivePhysicalIDs, AvailableGroups, Information
construction_3 = BridgeConstructionSequence(Model=bm, Phase=phase_3, ActiveBearingIDs="*", EnableBearings=True)  # -> PhaseModel, NativeStage, Phase, ActivePhysicalIDs, AvailableGroups, Information
audit = BridgeModelAudit(
    Model=bm,
    Tolerance=1e-06,
    BridgeGeometry=deckmesh.BridgeGeometry,
    PhaseModels=flatten([construction.PhaseModel, construction_2.PhaseModel, construction_3.PhaseModel]))  # -> NoInputErrors, Severity, Code, Element, Description, Model
description = Panel(audit.Description)
information = Panel(construction.Information)
information_2 = Panel(construction_2.Information)
information_3 = Panel(construction_3.Information)
