# Grasshopper definition 47-pioli-irrigidimenti-verifiche.ghx (Grasshopper 1.0.8)
# plug-ins: BridGHe

support_stations = Panel("""0
30000
70000
100000""")
# PREVIEW: Attivare la preview di Simple Bridge per vedere tutto il ponte. DetailLayout mostra solo il tratto studiato.
# La trave ha asse a -1500 mm; Steel Top Offset=1250 porta l'ala superiore a -250 mm. I pioli terminano a -70 mm.
# Nessuna rigidezza FEM viene aggiunta dalle mesh degli irrigidimenti.
girder_offsets = Panel("""-4000
0
4000""")
tracciato_100_m_quota_estradosso = Curve(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)
slabwidth = Panel("2200")
webheight = Panel("1330")
longitudinalpitch = Panel("200")
countperrow = Panel("2")
diameter = Panel("22")
width = Panel("200")
thickness = Panel("20")
externalcompressionkn = Panel("100")
reactionkn = Panel("900")
footprintlength = Panel("400")
# PANNELLI E REAZIONE: Intermedi bilaterali simmetrici; aL=aR=2000 mm; N aggiuntivo=100 kN.
# Appoggio INTERNO, R=900 kN compressiva, eccentricità nulle.
# R non viene ricavata dal taglio di sezione: è un input indipendente, già combinato. Gole: 6 mm intermedi, 10 mm appoggio.
# R e N aggiuntivo sono costanti nelle fasi di questo esempio.
footprintwidth = Panel("600")
girders = Panel("2")
stiffener_stations = Panel("""28000
32000""")

# ---- group: 01 DEFINIZIONI CONDIVISE E PREVIEW
# COME LEGGERE: 47 | PIOLI E IRRIGIDIMENTI — GEOMETRIA E VERIFICHE
# Leggere da sinistra a destra. La geometria è un ponte a 3 travi e 3 campate; il dettaglio riguarda G2 tra 26 e 34 m, attorno alla pila a 30 m.
# Le azioni locali sono un benchmark di taglio assegnato, non risultati Straus: M=N=T=0; 3 incrementi + ritiro. Non è la verifica completa di questo ponte.
# A: passo 200 mm. B: passo 400 mm. C: irrigidimento intermedio assottigliato a 8 mm. D: reazione d'appoggio aumentata.
# Aprire README.md per procedura, unità, risultati attesi e collegamento al modello FEM. Le definizioni gPC sono condivise tra layout e verificatore.
ponte_30_40_30_m = SimpleBridgeSolidDiaphragms(
    Alignment=tracciato_100_m_quota_estradosso,
    SupportStations=support_stations,
    GirderOffsets=girder_offsets,
    GirderLevels=-1500,
    DeckWidths=6000,
    DeckThickness=250,
    MaximumElementLength=2500,
    ChordTolerance=5,
    SupportSkew=0,
    Labels=False,
    DeckBeamSpacing=0)  # -> Members, MemberIDs, Longitudinals, DiaphragmMembers, Nodes, SupportPoints, JointPoints, Deck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
sezione_h_soletta = BridgeSectionGeometry(
    SlabWidth=slabwidth,
    SlabHeight=250,
    WebHeight=webheight,
    WebThickness=16,
    TopWidth=450,
    TopThickness=30,
    BottomWidth=600,
    BottomThickness=40,
    SecondBottomEnabled=False,
    SecondBottomWidth=600,
    SecondBottomThickness=20,
    SectionType=0,
    WebOffset=0,
    WebSpacing=1800)
intermedio_200x20 = BridgeIntermediateStiffener(
    Enabled=True,
    Layout=0,
    Width=width,
    Thickness=thickness,
    RightWidth=200,
    RightThickness=20,
    LeftPanel=2000,
    RightPanel=2000,
    EqualPanels=True,
    LengthFactor=1,
    ExternalCompressionKN=externalcompressionkn,
    LoadX=0,
    CheckWelds=True,
    WeldThroat=6)
# SEZIONE: Soletta efficace 2200 x 250 mm.
# Anima 1330 x 16 mm.
# Ala superiore 450 x 30; inferiore 600 x 40 mm.
# Due file longitudinali di armatura Ø16/150, asse a 40 mm dalle facce.
# Larghezza efficace assegnata: non deriva dalla larghezza del ponte.
pioli_a_passo_200 = BridgeStuds(
    Enabled=True,
    CountPerRow=countperrow,
    Diameter=diameter,
    Height=180,
    LongitudinalPitch=longitudinalpitch,
    TransversePitch=150,
    Fu=450,
    GammaV=1.25,
    HeadDiameter=35,
    HeadThickness=10,
    RequiredCover=40,
    RepeatedActionDetail=True)
appoggio_200x25_r900 = BridgeSupportStiffener(
    Enabled=True,
    Layout=0,
    Width=200,
    Thickness=25,
    RightWidth=250,
    RightThickness=25,
    Location=0,
    LeftPanel=2000,
    RightPanel=2000,
    ReactionKN=reactionkn,
    EndDistance=250,
    LoadX=0,
    LoadZ=0,
    FootprintLength=footprintlength,
    FootprintWidth=footprintwidth,
    LengthFactor=1,
    RigidEndPost=False,
    EndPostSpacing=300,
    CheckWelds=True,
    WeldThroat=10)
layout_g2_26_34_m = BridgeDetailLayout(
    BridgeGeometry=ponte_30_40_30_m.BridgeGeometry,
    SectionGeometry=sezione_h_soletta,
    Girders=girders,
    Start=26000,
    End=34000,
    SteelTopOffset=1250,
    Studs=pioli_a_passo_200,
    IntermediateStiffener=intermedio_200x20,
    SupportStiffener=appoggio_200x25_r900,
    StiffenerPitch=4000,
    StiffenerStations=stiffener_stations)  # -> StudAxes, StudHeads, StiffenerPlates, Details, IDs, Stations, Information

# ----
shearkn = Panel("300")
shearkn_2 = Panel("200")
shearkn_3 = Panel("800")
# INCREMENTI LOCALI: Bridge Section Increment usa kN/kNm e MICROSTRAIN: -200, non -0.0002.
# Ordine dei fili = ordine cronologico. M=N=T=0 in questo benchmark. I tagli sono incrementali: V finale=1300 kN.
# L'acciaio contribuisce al taglio dell'anima; il flusso dei pioli nasce dai soli incrementi misti. Il ritiro uniforme non genera qui flusso aggiuntivo.
shrinkagemicrostrain = Panel("-200")
_01_acciaio_v300 = BridgeSectionIncrement(
    Name="01 Acciaio V300",
    Active=True,
    Kind=0,
    Reference=0,
    ForceKN=0,
    MomentKNm=0,
    ShearKN=shearkn,
    TorsionKNm=0,
    AdditionalConnectionFlow=0,
    ShrinkageMicrostrain=0,
    HomogenizationSource=0,
    Phi=0,
    PsiL=1,
    N=6)
_02_misto_lento_v200 = BridgeSectionIncrement(
    Name="02 Misto lento V200",
    Active=True,
    Kind=1,
    Reference=0,
    ForceKN=0,
    MomentKNm=0,
    ShearKN=shearkn_2,
    TorsionKNm=0,
    AdditionalConnectionFlow=0,
    ShrinkageMicrostrain=0,
    HomogenizationSource=0,
    Phi=2,
    PsiL=1,
    N=6)
_03_misto_istantaneo_v800 = BridgeSectionIncrement(
    Name="03 Misto istantaneo V800",
    Active=True,
    Kind=1,
    Reference=0,
    ForceKN=0,
    MomentKNm=0,
    ShearKN=shearkn_3,
    TorsionKNm=0,
    AdditionalConnectionFlow=0,
    ShrinkageMicrostrain=0,
    HomogenizationSource=0,
    Phi=0,
    PsiL=1,
    N=6)
_04_ritiro_200_microstrain = BridgeSectionIncrement(
    Name="04 Ritiro -200 microstrain",
    Active=True,
    Kind=3,
    Reference=0,
    ForceKN=0,
    MomentKNm=0,
    ShearKN=0,
    TorsionKNm=0,
    AdditionalConnectionFlow=0,
    ShrinkageMicrostrain=shrinkagemicrostrain,
    HomogenizationSource=0,
    Phi=2,
    PsiL=1,
    N=6)
_80_pioli_e_6_piatti = Panel(layout_g2_26_34_m.Information)
c30_fck_30_mpa = Data(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)
s355_e210000_fy355_fu510_mpa = Data(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)
b450_e200000_fy450_fu540_mpa = Data(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)

# ---- group: 02 CALCOLO GPC E LETTURA DELLE COLONNE
slu_coefficienti_espliciti = BridgeAnalysisOptions(
    Standard=1,
    LimitState=0,
    Class4=True,
    TopFlangeBuckling=True,
    BottomFlangeBuckling=True,
    WebBuckling=True,
    CommonLoadY=0,
    GammaM0=1,
    GammaM1=1.1,
    GammaM2=1.25,
    GammaC=1.5,
    GammaS=1.15,
    AlphaCC=0.85,
    ShearEta=1.2)
due_file_ø16_150 = BridgeRebarRow(Enabled=True, Diameter=16, Pitch=150, AxisDistance=40)
a_sezione_con_dettagli = BridgeSectionCheck(
    Geometry=sezione_h_soletta,
    Concrete=c30_fck_30_mpa,
    Steel=s355_e210000_fy355_fu510_mpa,
    RebarMaterial=b450_e200000_fy450_fu540_mpa,
    Phases=[_01_acciaio_v300, _02_misto_lento_v200, _03_misto_istantaneo_v800, _04_ritiro_200_microstrain],
    TopRebars=due_file_ø16_150,
    BottomRebars=due_file_ø16_150,
    Details=[pioli_a_passo_200, intermedio_200x20, appoggio_200x25_r900],
    Options=slu_coefficienti_espliciti)  # -> Results, Phases, Warnings, NativeAnalysis
risultato_finale_indice_3 = ListItem(List=a_sezione_con_dettagli.Results, Index=3, Wrap=False)
a_risultati_pioli = BridgeStudResults(SectionResult=risultato_finale_indice_3)  # -> ConnectionFlow, ForcePerStud, ResistancePerStud, ResistancePerLength, ForceRatio, Phase, PhaseFlow, Warnings
a_tutti_i_controlli = BridgeVerificationResults(SectionResult=risultato_finale_indice_3)  # -> Check, Demand, Resistance, Units, Ratio, Status, Notes

# ----
# STATO LIMITE: LimitState=0 (Ultimate). Azioni già combinate, nessun fattore applicato agli incrementi dal componente.
# Standard=Eurocode4 è il selettore gPC; i coefficienti sono dati dimostrativi espliciti, non una scelta normativa automatica.
# GammaM0=1; M1=1.1; M2=1.25; GammaV pioli=1.25. Gli altri valori sono leggibili negli input.
ambito_e_controlli_da_completare = Panel(a_sezione_con_dettagli.Warnings)
ordine_risultati = Panel(a_sezione_con_dettagli.Phases)
longitudinalpitch_2 = Panel("400")
thickness_2 = Panel("8")
reactionkn_2 = Panel("3000")

# ---- group: 03 CONFRONTO C — piatto 8 mm
c_intermedio_200x8 = BridgeIntermediateStiffener(
    Enabled=True,
    Layout=0,
    Width=200,
    Thickness=thickness_2,
    RightWidth=200,
    RightThickness=20,
    LeftPanel=2000,
    RightPanel=2000,
    EqualPanels=True,
    LengthFactor=1,
    ExternalCompressionKN=100,
    LoadX=0,
    CheckWelds=True,
    WeldThroat=6)
c_piatto_8_mm = BridgeDetailCheck(SectionResult=risultato_finale_indice_3, IntermediateStiffener=c_intermedio_200x8)  # -> SectionResult, Check, Demand, Resistance, Units, Ratio, Status, Warnings

# ---- group: 03 CONFRONTO B — passo 400
b_pioli_passo_400 = BridgeStuds(
    Enabled=True,
    CountPerRow=2,
    Diameter=22,
    Height=180,
    LongitudinalPitch=longitudinalpitch_2,
    TransversePitch=150,
    Fu=450,
    GammaV=1.25,
    HeadDiameter=35,
    HeadThickness=10,
    RequiredCover=40,
    RepeatedActionDetail=True)
b_passo_400 = BridgeDetailCheck(SectionResult=risultato_finale_indice_3, Studs=b_pioli_passo_400)  # -> SectionResult, Check, Demand, Resistance, Units, Ratio, Status, Warnings

# ---- group: 03 CONFRONTO D — reazione 3000
d_appoggio_r3000 = BridgeSupportStiffener(
    Enabled=True,
    Layout=0,
    Width=200,
    Thickness=25,
    RightWidth=250,
    RightThickness=25,
    Location=0,
    LeftPanel=2000,
    RightPanel=2000,
    ReactionKN=reactionkn_2,
    EndDistance=250,
    LoadX=0,
    LoadZ=0,
    FootprintLength=400,
    FootprintWidth=600,
    LengthFactor=1,
    RigidEndPost=False,
    EndPostSpacing=300,
    CheckWelds=True,
    WeldThroat=10)
d_reazione_3000 = BridgeDetailCheck(SectionResult=risultato_finale_indice_3, SupportStiffener=d_appoggio_r3000)  # -> SectionResult, Check, Demand, Resistance, Units, Ratio, Status, Warnings

# ----
connection_flow = Panel(a_risultati_pioli.ConnectionFlow)
resistance_per_length = Panel(a_risultati_pioli.ResistancePerLength)
fasi_del_flusso = Panel(a_risultati_pioli.Phase)
check = Panel(a_tutti_i_controlli.Check)
demand = Panel(a_tutti_i_controlli.Demand)
force_per_stud = Panel(a_risultati_pioli.ForcePerStud)
force_ratio = Panel(a_risultati_pioli.ForceRatio)
dq_per_fase_n_mm = Panel(a_risultati_pioli.PhaseFlow)
check_b_passo_400 = Panel(b_passo_400.Check)
check_c_piatto_8_mm = Panel(c_piatto_8_mm.Check)
# COME CONFRONTARE: B: cambia soltanto il passo. q resta uguale, PEd raddoppia e qRd dimezza.
# C: cambia soltanto lo spessore intermedio. Cercare piatti entro classe 3 e rigidezza torsionale: gPC esclude il beneficio dei pannelli se l'irrigidimento non è idoneo.
# D: cambia soltanto la reazione assegnata. Le verifiche di appoggio peggiorano; il flusso dei pioli resta uguale.
# Una riga Non verificato è un esito strutturale, non un errore rosso del componente. NaN/Da verificare non significa verifica soddisfatta.
# I confronti B/C/D non cambiano la preview: il layout resta collegato alle definizioni A.
check_d_reazione_3000 = Panel(d_reazione_3000.Check)
resistance = Panel(a_tutti_i_controlli.Resistance)
resistance_per_stud = Panel(a_risultati_pioli.ResistancePerStud)
rapporto_b_passo_400 = Panel(b_passo_400.Ratio)
rapporto_c_piatto_8_mm = Panel(c_piatto_8_mm.Ratio)
rapporto_d_reazione_3000 = Panel(d_reazione_3000.Ratio)
units = Panel(a_tutti_i_controlli.Units)
esito_e_note_b_passo_400 = Panel(b_passo_400.Status)
esito_e_note_c_piatto_8_mm = Panel(c_piatto_8_mm.Status)
esito_e_note_d_reazione_3000 = Panel(d_reazione_3000.Status)
ratio = Panel(a_tutti_i_controlli.Ratio)
status = Panel(a_tutti_i_controlli.Status)
notes = Panel(a_tutti_i_controlli.Notes)
