# Grasshopper definition 49-ponte-parametrico.ghx (Grasshopper 1.0.8)
# plug-ins: BridGHe

# ---- group: 01 | Campate, tracciato e travi
# COME USARE IL PONTE PARAMETRICO: 49 | PONTE PARAMETRICO — INPUT A SINISTRA / COMPONENTI AL CENTRO / OUTPUT A DESTRA
# Unità: N, mm, MPa. Slider numero campate/travi, luce/interasse; liste opzionali per geometrie non regolari.
# Diaframmi reticolari: True = X/V/Warren; False = anima piena. La preview del modello è in basso al centro.
# SEZIONI CONCI: tabella nel gruppo 05b. Una riga per Gx-Cy; * segue gli slider base. Pulsante Tabella conci per aggiornare i giunti.
# La soletta è a graticcio: assi trasversali alla quota reale, link eccentrici e proprietà per ogni fascia.
# La quota degli assi travi è un input indipendente: aggiornarla se cambia il baricentro della sezione.
# Modelli senza carichi e senza analisi. La rigidezza longitudinale mista va assegnata nelle fasi tramite override delle sezioni.
# Il modello è predisposto per Straus. Per luci/interassi/sezioni modificati: verificare appoggi, proprietà e calibrazione del graticcio.
# README e script di rigenerazione nella cartella 49-ponte-parametrico.
lunghezze_campate_diverse_mm_sostituisco = Number()  # "Lunghezze campate diverse [mm] — sostituiscono numero e luce (opzionale)"
offset_trasversali_non_uniformi_mm_destr = Number()  # "Offset trasversali non uniformi [mm] — destra negativi (opzionale)"
tracciato_rhino_3d_lunghezza_campate_pro = Curve()  # "Tracciato Rhino 3D — lunghezza = campate + prolungamenti (opzionale)"
tipi_appoggi_personalizzati_ordine_appog = Integer()  # "Tipi appoggi personalizzati — ordine appoggio poi trave (opzionale)"
numero_campate = Slider(3, range=1..12)
lunghezza_campata_regolare_mm = Slider(30000, range=5000..80000)
numero_travi_longitudinali = Slider(3, range=2..10)
interasse_regolare_travi_mm = Slider(3500, range=1000..10000)
sbalzo_laterale_sinistro_soletta_mm = Slider(1500, range=0..4000)
sbalzo_laterale_destro_soletta_mm = Slider(1500, range=0..4000)
prolungamento_prima_del_primo_appoggio_m = Slider(0, range=0..15000)  # "Prolungamento prima del primo appoggio [mm]"
prolungamento_dopo_ultimo_appoggio_mm = Slider(0, range=0..15000)
raggio_in_pianta_mm_0_rettilineo_segno_l = Slider(0, range=-1000000..1000000)  # "Raggio in pianta [mm] — 0 rettilineo; segno = lato curva"
origine_del_tracciato_mm = Panel("0,0,0")
rotazione_iniziale_tracciato_deg = Slider(0, range=-180..180)
passo_massimo_controventi_longitudinali = Slider(6000, range=1000..15000)  # "Passo massimo controventi longitudinali [mm]"

# ---- group: 02 | Soletta, quote, mesh e sghembi
progressive_soletta_personalizzate_mm_so = Number()  # "Progressive soletta personalizzate [mm] — sostituiscono il passo (opzionale)"
quota_asse_soletta_mm_vuoto_metà_spessor = Number()  # "Quota asse soletta [mm] — vuoto = metà spessore (opzionale)"
mostra_etichette_geometriche = BooleanToggle(False)
diaframmi_reticolari_false_anima_piena = BooleanToggle(False)
quota_assi_travi_rispetto_all_estradosso = Slider(-1550, range=-5000..-300)  # "Quota assi travi rispetto all'estradosso [mm]"
spessore_soletta_mm = Slider(300, range=150..500)
pendenza_trasversale_soletta = Slider(0, range=-8..8)
lunghezza_massima_elementi_longitudinali = Slider(3000, range=500..6000)  # "Lunghezza massima elementi longitudinali [mm]"
tolleranza_discretizzazione_in_curva_mm = Slider(5, range=0.1..20)
sghembo_appoggi_deg_prevedere_prolungame = Slider(0, range=-45..45)  # "Sghembo appoggi [deg] — prevedere prolungamenti agli estremi"
passo_massimo_aste_trasversali_soletta_m = Slider(3000, range=500..6000)  # "Passo massimo aste trasversali soletta [mm]"

# ---- group: 03 | Conci e diaframmi
giunti_mm_rami_0_comuni_n_trave_n_opzion = Number()  # "Giunti [mm] — rami {0} comuni, {n} trave n (opzionale)"
progressive_diaframmi_personalizzate_mm = Number()  # "Progressive diaframmi personalizzate [mm] (opzionale)"
diaframmi_sulle_linee_di_appoggio = BooleanToggle(True)
schema_diaframma_reticolare = ValueList({"X": 0, "V": 1, "Warren": 2}, selected="X")
nodo_all_incrocio_delle_diagonali_x = BooleanToggle(False)
lunghezza_massima_concio_mm = Slider(12000, range=0..24000)
passo_massimo_diaframmi_mm = Slider(6000, range=0..15000)
altezza_reticolo_dei_diaframmi_mm = Slider(1800, range=500..4000)
numero_pannelli_reticolari_fra_due_travi = Slider(2, range=1..8)

# ---- group: 04 | Controventi longitudinali
campi_tra_travi_da_controventare_vuoto_t = Integer()  # "Campi tra travi da controventare — vuoto = tutti (opzionale)"
numeri_campi_longitudinali_da_omettere_o = Integer()  # "Numeri campi longitudinali da omettere (opzionale)"
schema_controventi_longitudinali = ValueList({"X": 0, "V": 1, "Alternati": 2}, selected="X")
nodo_all_incrocio_controventi_x = BooleanToggle(False)
aggiungi_controventi_longitudinali = BooleanToggle(True)
offset_normale_controventi_dagli_assi_tr = Slider(0, range=-3000..3000)  # "Offset normale controventi dagli assi travi [mm]"

# ---- group: 06 | Appoggi, eccentricità e assemblaggio
selezione_appoggi_vuoto_tutti_opzionale = Integer()
selezione_travi_agli_appoggi_vuoto_tutte = Integer()  # "Selezione travi agli appoggi — vuoto = tutte (opzionale)"
piano_degli_appoggi_vuoto_tangente_orizz = Plane()  # "Piano degli appoggi — vuoto = tangente orizzontale (opzionale)"
proprietà_aste_di_collegamento_necessari = Data()  # "Proprietà aste di collegamento — necessaria solo nel modo 1 (opzionale)"
collegamento_trave_soletta = ValueList({"Link cinematico rigido": 0, "Asta deformabile con proprietà esplicita": 1}, selected="Link cinematico rigido")
modello_sola_carpenteria_unità_del_model = ValueList({"N, mm, MPa": 2}, selected="N, mm, MPa")  # "Modello sola carpenteria | Unità del modello"
modello_graticcio_con_soletta_unità_del = ValueList({"N, mm, MPa": 2}, selected="N, mm, MPa")  # "Modello graticcio con soletta | Unità del modello"
rotazione_guide_degli_appoggi_deg = Slider(0, range=-180..180)
rigidezze_elastiche_kx_ky_kz_n_mm = Panel("0,0,0")
rigidezze_elastiche_krx_kry_krz_n_mm_rad = Panel("0,0,0")
modello_sola_carpenteria_nome_modello = Panel("Modello sola carpenteria")
modello_graticcio_con_soletta_nome_model = Panel("Modello graticcio con soletta")  # "Modello graticcio con soletta | Nome modello"
tolleranza_audit_del_modello_mm = Slider(0.001, range=0.001..1)

# ---- group: 09 | Altri parametri e ingressi opzionali
collegamenti_eccentrici_trave_soletta_be = Data()  # "Collegamenti eccentrici trave-soletta | Beams (opzionale)"
modello_sola_carpenteria_staged_construc = Data()  # "Modello sola carpenteria | Staged constructions (opzionale)"
modello_graticcio_con_soletta_staged_con = Data()  # "Modello graticcio con soletta | Staged constructions (opzionale)"
controllo_connessioni_e_proprietà_bridge = Data()  # "Controllo connessioni e proprietà | Bridge Geometry (opzionale)"
controllo_connessioni_e_proprietà_phase = Data()  # "Controllo connessioni e proprietà | Phase Models (opzionale)"
opzioni_preview_load_case_vuoto = Text("")
geometria_con_senza_controventi_wrap = BooleanToggle(True)
modello_sola_carpenteria_load_combinatio = LoadCombinations()  # "Modello sola carpenteria | Load Combinations (opzionale)"
modello_graticcio_con_soletta_load_combi = LoadCombinations()  # "Modello graticcio con soletta | Load Combinations (opzionale)"
opzioni_preview_enabled = BooleanToggle(True)
opzioni_preview_geometry = BooleanToggle(True)
opzioni_preview_sections = BooleanToggle(True)
opzioni_preview_shaded = BooleanToggle(True)
opzioni_preview_reinforcement = BooleanToggle(True)
opzioni_preview_loads = BooleanToggle(True)
opzioni_preview_supports = BooleanToggle(True)
opzioni_preview_releases = BooleanToggle(True)
opzioni_preview_otherattributes = BooleanToggle(True)
opzioni_preview_axes = BooleanToggle(False)
opzioni_preview_labels = BooleanToggle(False)
proprietà_famiglia_1_group = Slider(0, range=0..10)
proprietà_famiglia_1_segment = Slider(0, range=0..10)
proprietà_famiglia_1_start_scale = Panel("1,1,0")
proprietà_famiglia_1_end_scale = Panel("1,1,0")
proprietà_famiglia_2_group = Slider(0, range=0..10)
proprietà_famiglia_2_segment = Slider(0, range=0..10)
proprietà_famiglia_2_start_scale = Panel("1,1,0")
proprietà_famiglia_2_end_scale = Panel("1,1,0")
proprietà_famiglia_3_group = Slider(0, range=0..10)
proprietà_famiglia_3_segment = Slider(0, range=0..10)
proprietà_famiglia_3_start_scale = Panel("1,1,0")
proprietà_famiglia_3_end_scale = Panel("1,1,0")
proprietà_famiglia_4_group = Slider(0, range=0..10)
proprietà_famiglia_4_segment = Slider(0, range=0..10)
proprietà_famiglia_4_start_scale = Panel("1,1,0")
proprietà_famiglia_4_end_scale = Panel("1,1,0")
proprietà_famiglia_5_group = Slider(0, range=0..10)
proprietà_famiglia_5_segment = Slider(0, range=0..10)
proprietà_famiglia_5_start_scale = Panel("1,1,0")
proprietà_famiglia_5_end_scale = Panel("1,1,0")
proprietà_famiglia_6_group = Slider(0, range=0..10)
proprietà_famiglia_6_segment = Slider(0, range=0..10)
proprietà_famiglia_6_start_scale = Panel("1,1,0")
proprietà_famiglia_6_end_scale = Panel("1,1,0")
proprietà_famiglia_7_group = Slider(0, range=0..10)
proprietà_famiglia_7_segment = Slider(0, range=0..10)
proprietà_famiglia_7_start_scale = Panel("1,1,0")
proprietà_famiglia_7_end_scale = Panel("1,1,0")
fasce_soletta_fem_name = Panel("Soletta trasversale")
collegamenti_eccentrici_trave_soletta_of = Panel("0,0,0")  # "Collegamenti eccentrici trave-soletta | Offset"
materiale_armature_b450c_name = Panel("B450C")
opzioni_preview_symbol_scale = Slider(1, range=0..2)
opzioni_preview_load_scale = Slider(1, range=0..2)
opzioni_preview_transparency = Slider(0.65, range=0..1.3)

# ----
campate_e_tracciato = BridgeParametricLayout(
    SpanCount=numero_campate,
    SpanLength=lunghezza_campata_regolare_mm,
    SpanLengths=lunghezze_campate_diverse_mm_sostituisco,
    GirderCount=numero_travi_longitudinali,
    GirderSpacing=interasse_regolare_travi_mm,
    GirderOffsets=offset_trasversali_non_uniformi_mm_destr,
    LeftOverhang=sbalzo_laterale_sinistro_soletta_mm,
    RightOverhang=sbalzo_laterale_destro_soletta_mm,
    StartOverhang=prolungamento_prima_del_primo_appoggio_m,
    EndOverhang=prolungamento_dopo_ultimo_appoggio_mm,
    Radius=raggio_in_pianta_mm_0_rettilineo_segno_l,
    Origin=origine_del_tracciato_mm,
    Heading=rotazione_iniziale_tracciato_deg,
    CustomAlignment=tracciato_rhino_3d_lunghezza_campate_pro,
    BracingSpacing=passo_massimo_controventi_longitudinali,
    BearingTypesOverride=tipi_appoggi_personalizzati_ordine_appog)  # -> Alignment, SupportStations, GirderOffsets, DeckWidths, SpanLengths, BearingTypes, Length, Information, BracingStations
tracciato_effettivo = TracciatoEffettivo(campate_e_tracciato.Alignment)
progressive_appoggi = ProgressiveAppoggi(campate_e_tracciato.SupportStations)
offset_effettivi_travi = OffsetEffettiviTravi(campate_e_tracciato.GirderOffsets)
luci_effettive_campate = LuciEffettiveCampate(campate_e_tracciato.SpanLengths)
progressive_campi_controventi = ProgressiveCampiControventi(campate_e_tracciato.BracingStations)
conci_di_officina = BridgeSegments(Joints=giunti_mm_rami_0_comuni_n_trave_n_opzion, MaximumLength=lunghezza_massima_concio_mm)
disposizione_diaframmi = BridgeDiaphragms(
    Stations=progressive_diaframmi_personalizzate_mm,
    MaximumSpacing=passo_massimo_diaframmi_mm,
    AtSupports=diaframmi_sulle_linee_di_appoggio,
    TrussHeight=altezza_reticolo_dei_diaframmi_mm,
    PanelsPerBay=numero_pannelli_reticolari_fra_due_travi,
    Pattern=schema_diaframma_reticolare,
    ConnectX=nodo_all_incrocio_delle_diagonali_x)
ponte_geometrico = SimpleBridge(
    Alignment=campate_e_tracciato.Alignment,
    SupportStations=campate_e_tracciato.SupportStations,
    GirderOffsets=campate_e_tracciato.GirderOffsets,
    GirderLevels=quota_assi_travi_rispetto_all_estradosso,
    DeckWidths=campate_e_tracciato.DeckWidths,
    DeckThickness=spessore_soletta_mm,
    Crossfall=pendenza_trasversale_soletta,
    Segments=conci_di_officina,
    Diaphragms=disposizione_diaframmi,
    MaximumElementLength=lunghezza_massima_elementi_longitudinali,
    ChordTolerance=tolleranza_discretizzazione_in_curva_mm,
    SupportSkew=sghembo_appoggi_deg_prevedere_prolungame,
    Labels=mostra_etichette_geometriche,
    DeckBeamSpacing=passo_massimo_aste_trasversali_soletta_m,
    DeckBeamStations=progressive_soletta_personalizzate_mm_so,
    DeckBeamLevel=quota_asse_soletta_mm_vuoto_metà_spessor,
    TrussDiaphragms=diaframmi_reticolari_false_anima_piena)  # -> Members, MemberIDs, Longitudinals, DiaphragmMembers, Nodes, SupportPoints, JointPoints, Deck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
assi_carpenteria_per_famiglia = AssiCarpenteriaPerFamiglia(ponte_geometrico.Members)
id_degli_assi = IDDegliAssi(ponte_geometrico.MemberIDs)
travi_longitudinali_per_concio = TraviLongitudinaliPerConcio(ponte_geometrico.Longitudinals)
diaframmi_per_famiglia = DiaframmiPerFamiglia(ponte_geometrico.DiaphragmMembers)
nodi_geometrici_carpenteria = NodiGeometriciCarpenteria(ponte_geometrico.Nodes)
punti_di_appoggio = PuntiDiAppoggio(ponte_geometrico.SupportPoints)
punti_dei_giunti_di_concio = PuntiDeiGiuntiDiConcio(ponte_geometrico.JointPoints)
volume_geometrico_soletta = VolumeGeometricoSoletta(ponte_geometrico.Deck)
bordi_soletta = BordiSoletta(ponte_geometrico.DeckEdges)
riferimenti_locali = RiferimentiLocali(ponte_geometrico.Frames)
progressive_mesh = ProgressiveMesh(ponte_geometrico.Stations)
tabella_topologia = TabellaTopologia(ponte_geometrico.Topology)
tabella_conci = TabellaConci(ponte_geometrico.SegmentRanges)
informazioni_geometria = InformazioniGeometria(ponte_geometrico.Information)
geometria_carpenteria_di_base = GeometriaCarpenteriaDiBase(ponte_geometrico.BridgeGeometry)
assi_trasversali_soletta = AssiTrasversaliSoletta(ponte_geometrico.DeckBeams)
assi_eccentricità_trave_soletta = AssiEccentricitàTraveSoletta(ponte_geometrico.DeckConnections)
progressive_fasce_soletta = ProgressiveFasceSoletta(ponte_geometrico.DeckBeamStations)
larghezze_tributarie_fasce = LarghezzeTributarieFasce(ponte_geometrico.DeckStripWidths)
geometria_acciaio_fasce_soletta = GeometriaAcciaioFasceSoletta(ponte_geometrico.GrillageGeometry)
id_fasce_soletta = IDFasceSoletta(ponte_geometrico.DeckMemberIDs)
controventi_longitudinali = BridgeLongitudinalBracing(
    BridgeGeometry=ponte_geometrico.BridgeGeometry,
    Stations=campate_e_tracciato.BracingStations,
    Bays=campi_tra_travi_da_controventare_vuoto_t,
    Pattern=schema_controventi_longitudinali,
    NormalOffset=offset_normale_controventi_dagli_assi_tr,
    ConnectX=nodo_all_incrocio_controventi_x,
    OmittedPanels=numeri_campi_longitudinali_da_omettere_o)  # -> BridgeGeometry, AddedMembers, Information
assi_controventi_generati_secondo_selett = AssiControventiGeneratiSecondoSelettorePerIlModello(controventi_longitudinali.AddedMembers)
geometria_con_senza_controventi = ListItem(
    List=flatten([ponte_geometrico.BridgeGeometry, controventi_longitudinali.BridgeGeometry]),
    Index=aggiungi_controventi_longitudinali,
    Wrap=geometria_con_senza_controventi_wrap)
geometria_carpenteria_con_opzione_contro = GeometriaCarpenteriaConOpzioneControventi(geometria_con_senza_controventi)

# ---- group: 05 | Materiali e sezioni FEM
classe_acciaio = ValueList({"S235": 0, "S275": 1, "S355": 2, "S450": 3}, selected="S355")
classe_calcestruzzo = ValueList({"C25/30": 4, "C28/35": 5, "C32/40": 6, "C35/45": 7, "C40/50": 8, "C45/55": 9, "C50/60": 10}, selected="C32/40")
travi_principali_formulazione_fem = ValueList({"Beam con flessione e torsione": 5, "Truss solo assiale": 2}, selected="Beam con flessione e torsione")
traversi_pieni_formulazione_fem = ValueList({"Beam con flessione e torsione": 5, "Truss solo assiale": 2}, selected="Beam con flessione e torsione")
correnti_formulazione_fem = ValueList({"Beam con flessione e torsione": 5, "Truss solo assiale": 2}, selected="Beam con flessione e torsione")
montanti_formulazione_fem = ValueList({"Beam con flessione e torsione": 5, "Truss solo assiale": 2}, selected="Beam con flessione e torsione")
diagonali_formulazione_fem = ValueList({"Beam con flessione e torsione": 5, "Truss solo assiale": 2}, selected="Beam con flessione e torsione")
nome_materiale_acciaio = Panel("Acciaio carpenteria")
nome_materiale_calcestruzzo = Panel("Calcestruzzo soletta")
sezione_travi_principali_larghezza_ala_i = Slider(600, range=1..1200)  # "Sezione travi principali | Larghezza ala inferiore [mm]"
sezione_travi_principali_larghezza_ala_s = Slider(600, range=1..1200)  # "Sezione travi principali | Larghezza ala superiore [mm]"
sezione_travi_principali_altezza_totale = Slider(2500, range=1..5000)  # "Sezione travi principali | Altezza totale [mm]"
sezione_travi_principali_spessore_ala_in = Slider(30, range=1..60)  # "Sezione travi principali | Spessore ala inferiore [mm]"
sezione_travi_principali_spessore_ala_su = Slider(30, range=1..60)  # "Sezione travi principali | Spessore ala superiore [mm]"
sezione_travi_principali_spessore_anima = Slider(16, range=1..50)  # "Sezione travi principali | Spessore anima [mm]"
sezione_travi_principali_raggio_raccordo = Slider(0, range=0..50)  # "Sezione travi principali | Raggio raccordo [mm]"
sezione_diaframma_pieno_larghezza_ala_in = Slider(300, range=1..600)  # "Sezione diaframma pieno | Larghezza ala inferiore [mm]"
sezione_diaframma_pieno_larghezza_ala_su = Slider(300, range=1..600)  # "Sezione diaframma pieno | Larghezza ala superiore [mm]"
sezione_diaframma_pieno_altezza_totale_m = Slider(900, range=1..1800)  # "Sezione diaframma pieno | Altezza totale [mm]"
sezione_diaframma_pieno_spessore_ala_inf = Slider(20, range=1..50)  # "Sezione diaframma pieno | Spessore ala inferiore [mm]"
sezione_diaframma_pieno_spessore_ala_sup = Slider(20, range=1..50)  # "Sezione diaframma pieno | Spessore ala superiore [mm]"
sezione_diaframma_pieno_spessore_anima_m = Slider(12, range=1..50)  # "Sezione diaframma pieno | Spessore anima [mm]"
sezione_diaframma_pieno_raggio_raccordo = Slider(0, range=0..50)  # "Sezione diaframma pieno | Raggio raccordo [mm]"
correnti_reticolari_altezza_mm = Slider(250, range=50..600)
correnti_reticolari_larghezza_mm = Slider(250, range=50..600)
correnti_reticolari_spessore_orizzontale = Slider(10, range=2..30)  # "Correnti reticolari | Spessore orizzontale [mm]"
correnti_reticolari_spessore_verticale_m = Slider(10, range=2..30)  # "Correnti reticolari | Spessore verticale [mm]"
montanti_reticolari_altezza_mm = Slider(200, range=50..600)
montanti_reticolari_larghezza_mm = Slider(200, range=50..600)
montanti_reticolari_spessore_orizzontale = Slider(8, range=2..30)  # "Montanti reticolari | Spessore orizzontale [mm]"
montanti_reticolari_spessore_verticale_m = Slider(8, range=2..30)  # "Montanti reticolari | Spessore verticale [mm]"
diagonali_e_controventi_altezza_mm = Slider(180, range=50..600)
diagonali_e_controventi_larghezza_mm = Slider(180, range=50..600)
diagonali_e_controventi_spessore_orizzon = Slider(8, range=2..30)  # "Diagonali e controventi | Spessore orizzontale [mm]"
diagonali_e_controventi_spessore_vertica = Slider(8, range=2..30)  # "Diagonali e controventi | Spessore verticale [mm]"
travi_principali_nome_proprietà = Panel("Travi principali")
traversi_pieni_nome_proprietà = Panel("Traversi pieni")
correnti_nome_proprietà = Panel("Correnti")
montanti_nome_proprietà = Panel("Montanti")
diagonali_nome_proprietà = Panel("Diagonali")

# ----
materiale_carpenteria = Steel(Name=nome_materiale_acciaio, Grade=classe_acciaio)
materiale_acciaio = MaterialeAcciaio(materiale_carpenteria)
materiale_soletta = Concrete(Name=nome_materiale_calcestruzzo, Grade=classe_calcestruzzo)
materiale_calcestruzzo = MaterialeCalcestruzzo(materiale_soletta)
sezione_travi_principali = ISection(
    BottomFlangeWidth=sezione_travi_principali_larghezza_ala_i,
    TopFlangeWidth=sezione_travi_principali_larghezza_ala_s,
    Height=sezione_travi_principali_altezza_totale,
    BottomFlangeThickness=sezione_travi_principali_spessore_ala_in,
    TopFlangeThickness=sezione_travi_principali_spessore_ala_su,
    WebThickness=sezione_travi_principali_spessore_anima,
    Radius=sezione_travi_principali_raggio_raccordo)
sezione_acciaio_base_le_sezioni_effettiv = SezioneAcciaioBASELeSezioniEffettiveSonoDistintePerConcio(sezione_travi_principali)
sezione_diaframma_pieno = ISection(
    BottomFlangeWidth=sezione_diaframma_pieno_larghezza_ala_in,
    TopFlangeWidth=sezione_diaframma_pieno_larghezza_ala_su,
    Height=sezione_diaframma_pieno_altezza_totale_m,
    BottomFlangeThickness=sezione_diaframma_pieno_spessore_ala_inf,
    TopFlangeThickness=sezione_diaframma_pieno_spessore_ala_sup,
    WebThickness=sezione_diaframma_pieno_spessore_anima_m,
    Radius=sezione_diaframma_pieno_raggio_raccordo)
correnti_reticolari = HollowRect(
    Height=correnti_reticolari_altezza_mm,
    Base=correnti_reticolari_larghezza_mm,
    HorizontalThickness=correnti_reticolari_spessore_orizzontale,
    VerticalThickness=correnti_reticolari_spessore_verticale_m)
montanti_reticolari = HollowRect(
    Height=montanti_reticolari_altezza_mm,
    Base=montanti_reticolari_larghezza_mm,
    HorizontalThickness=montanti_reticolari_spessore_orizzontale,
    VerticalThickness=montanti_reticolari_spessore_verticale_m)
diagonali_e_controventi = HollowRect(
    Height=diagonali_e_controventi_altezza_mm,
    Base=diagonali_e_controventi_larghezza_mm,
    HorizontalThickness=diagonali_e_controventi_spessore_orizzon,
    VerticalThickness=diagonali_e_controventi_spessore_vertica)
travi_principali = BeamProperty(
    Name=travi_principali_nome_proprietà,
    Type=travi_principali_formulazione_fem,
    Section=sezione_travi_principali,
    Material=materiale_carpenteria,
    Name_2=travi_principali_nome_proprietà,
    Type_2=travi_principali_formulazione_fem,
    Section_2=sezione_travi_principali,
    Material_2=materiale_carpenteria,
    Release=1)  # -> Property, Property_2
proprietà_fem_travi_principali = ProprietàFEMTraviPrincipali(travi_principali.Property_2)
traversi_pieni = BeamProperty(
    Name=traversi_pieni_nome_proprietà,
    Type=traversi_pieni_formulazione_fem,
    Section=sezione_diaframma_pieno,
    Material=materiale_carpenteria,
    Name_2=traversi_pieni_nome_proprietà,
    Type_2=traversi_pieni_formulazione_fem,
    Section_2=sezione_diaframma_pieno,
    Material_2=materiale_carpenteria,
    Release=1)  # -> Property, Property_2
proprietà_fem_traversi_pieni = ProprietàFEMTraversiPieni(traversi_pieni.Property_2)
correnti = BeamProperty(
    Name=correnti_nome_proprietà,
    Type=correnti_formulazione_fem,
    Section=correnti_reticolari,
    Material=materiale_carpenteria,
    Name_2=correnti_nome_proprietà,
    Type_2=correnti_formulazione_fem,
    Section_2=correnti_reticolari,
    Material_2=materiale_carpenteria,
    Release=1)  # -> Property, Property_2
proprietà_fem_correnti = ProprietàFEMCorrenti(correnti.Property_2)
montanti = BeamProperty(
    Name=montanti_nome_proprietà,
    Type=montanti_formulazione_fem,
    Section=montanti_reticolari,
    Material=materiale_carpenteria,
    Name_2=montanti_nome_proprietà,
    Type_2=montanti_formulazione_fem,
    Section_2=montanti_reticolari,
    Material_2=materiale_carpenteria,
    Release=1)  # -> Property, Property_2
proprietà_fem_montanti = ProprietàFEMMontanti(montanti.Property_2)
diagonali = BeamProperty(
    Name=diagonali_nome_proprietà,
    Type=diagonali_formulazione_fem,
    Section=diagonali_e_controventi,
    Material=materiale_carpenteria,
    Name_2=diagonali_nome_proprietà,
    Type_2=diagonali_formulazione_fem,
    Section_2=diagonali_e_controventi,
    Material_2=materiale_carpenteria,
    Release=1)  # -> Property, Property_2
proprietà_fem_diagonali = ProprietàFEMDiagonali(diagonali.Property_2)
fasce_soletta_fem = BridgeSlabGrillage(GrillageGeometry=ponte_geometrico.GrillageGeometry, ConcreteMaterial=materiale_soletta, Name=fasce_soletta_fem_name)  # -> Beams, Properties, StripWidths, MemberIDs, Information
elementi_fem_fasce_soletta = ElementiFEMFasceSoletta(fasce_soletta_fem.Beams)
proprietà_individuali_fasce_soletta = ProprietàIndividualiFasceSoletta(fasce_soletta_fem.Properties)
larghezze_individuali_fasce_fem_mm = LarghezzeIndividualiFasceFEMMm(fasce_soletta_fem.StripWidths)
id_fasce_fem = IDFasceFEM(fasce_soletta_fem.MemberIDs)
appoggi_orientati = BridgeBearings(
    BridgeGeometry=geometria_con_senza_controventi,
    Supports=selezione_appoggi_vuoto_tutti_opzionale,
    Girders=selezione_travi_agli_appoggi_vuoto_tutte,
    Types=campate_e_tracciato.BearingTypes,
    GuideAngle=rotazione_guide_degli_appoggi_deg,
    TranslationStiffness=rigidezze_elastiche_kx_ky_kz_n_mm,
    RotationStiffness=rigidezze_elastiche_krx_kry_krz_n_mm_rad,
    Orientation=piano_degli_appoggi_vuoto_tangente_orizz)  # -> Nodes, Frames, Labels
nodi_con_vincoli_e_molle = NodiConVincoliEMolle(appoggi_orientati.Nodes)
piani_locali_dei_vincoli = PianiLocaliDeiVincoli(appoggi_orientati.Frames)
id_appoggio_e_tipo_vincolo = IDAppoggioETipoVincolo(appoggi_orientati.Labels)
collegamenti_eccentrici_trave_soletta = BridgeConnections(
    Mode=collegamento_trave_soletta,
    Connections=flatten(ponte_geometrico.DeckConnections),
    Property=proprietà_aste_di_collegamento_necessari,
    Beams=collegamenti_eccentrici_trave_soletta_be,
    Offset=collegamenti_eccentrici_trave_soletta_of)  # -> Elements, Information
link_rigidi_oppure_aste_di_collegamento = LinkRigidiOppureAsteDiCollegamento(collegamenti_eccentrici_trave_soletta.Elements)
materiale_armature_b450c = ReinforcementSteelB450C(Name=materiale_armature_b450c_name)  # -> Material, Information
materiale_armature_b450c_2 = MaterialeArmatureB450C(materiale_armature_b450c.Material)
opzioni_preview = DisplaySettings(
    Enabled=opzioni_preview_enabled,
    Geometry=opzioni_preview_geometry,
    Sections=opzioni_preview_sections,
    Shaded=opzioni_preview_shaded,
    Reinforcement=opzioni_preview_reinforcement,
    Loads=opzioni_preview_loads,
    Supports=opzioni_preview_supports,
    Releases=opzioni_preview_releases,
    OtherAttributes=opzioni_preview_otherattributes,
    Axes=opzioni_preview_axes,
    Labels=opzioni_preview_labels,
    SymbolScale=opzioni_preview_symbol_scale,
    LoadScale=opzioni_preview_load_scale,
    Transparency=opzioni_preview_transparency,
    LoadCase=opzioni_preview_load_case_vuoto)

# ---- group: 05b | Sezioni per concio — modifica una riga per ogni Gx-Cy
sezioni_conci_mm_slider_sezione_base = Panel("""# ID; s_inizio_mm; s_fine_mm; b_inf_mm; b_sup_mm; h_mm; t_inf_mm; t_sup_mm; tw_mm; r_mm
G1-C1; 0; 11250; *; *; *; *; *; *; *
G1-C2; 11250; 22500; *; *; *; *; *; *; *
G1-C3; 22500; 33750; *; *; *; *; *; *; *
G1-C4; 33750; 45000; *; *; *; *; *; *; *
G1-C5; 45000; 56250; *; *; *; *; *; *; *
G1-C6; 56250; 67500; *; *; *; *; *; *; *
G1-C7; 67500; 78750; *; *; *; *; *; *; *
G1-C8; 78750; 90000; *; *; *; *; *; *; *
G2-C1; 0; 11250; *; *; *; *; *; *; *
G2-C2; 11250; 22500; *; *; *; *; *; *; *
G2-C3; 22500; 33750; *; *; *; *; *; *; *
G2-C4; 33750; 45000; *; *; *; *; *; *; *
G2-C5; 45000; 56250; *; *; *; *; *; *; *
G2-C6; 56250; 67500; *; *; *; *; *; *; *
G2-C7; 67500; 78750; *; *; *; *; *; *; *
G2-C8; 78750; 90000; *; *; *; *; *; *; *
G3-C1; 0; 11250; *; *; *; *; *; *; *
G3-C2; 11250; 22500; *; *; *; *; *; *; *
G3-C3; 22500; 33750; *; *; *; *; *; *; *
G3-C4; 33750; 45000; *; *; *; *; *; *; *
G3-C5; 45000; 56250; *; *; *; *; *; *; *
G3-C6; 56250; 67500; *; *; *; *; *; *; *
G3-C7; 67500; 78750; *; *; *; *; *; *; *
G3-C8; 78750; 90000; *; *; *; *; *; *; *""")
famiglia_proprietà_di_base_1_tutte_le_fa = Panel("-1")  # "Famiglia proprietà di base — -1 tutte le famiglie acciaio"
famiglia_1_inizio_assegnazione_mm = Slider(0, range=0..200000)
codice_famiglia_1 = Slider(1, range=0..8)
famiglia_2_inizio_assegnazione_mm = Slider(0, range=0..200000)
codice_famiglia_2 = Slider(2, range=0..8)
famiglia_3_inizio_assegnazione_mm = Slider(0, range=0..200000)
codice_famiglia_3 = Slider(3, range=0..8)
famiglia_4_inizio_assegnazione_mm = Slider(0, range=0..200000)
codice_famiglia_4 = Slider(4, range=0..8)
famiglia_5_inizio_assegnazione_mm = Slider(0, range=0..200000)
codice_famiglia_5 = Slider(5, range=0..8)
famiglia_6_inizio_assegnazione_mm = Slider(0, range=0..200000)
codice_famiglia_6 = Slider(6, range=0..8)
famiglia_7_inizio_assegnazione_mm = Slider(0, range=0..200000)
codice_famiglia_7 = Slider(7, range=0..8)

# ----
sezione_di_ogni_concio = BridgeSegmentSections(
    BridgeGeometry=geometria_con_senza_controventi,
    BaseProperty=travi_principali.Property_2,
    SectionTable=sezioni_conci_mm_slider_sezione_base)  # -> Schedule, Properties, Sections, SegmentIDs, ResolvedTable, TopOffsets, Information
sezione_acciaio_di_ciascun_concio_per_se = SezioneAcciaioDiCiascunConcioPerSezioniMisteEOverride(sezione_di_ogni_concio.Sections)
proprietà_fem_di_ciascun_concio = ProprietàFEMDiCiascunConcio(sezione_di_ogni_concio.Properties)
id_ordinati_delle_sezioni_g_trave_c_conc = IDOrdinatiDelleSezioniGTraveCConcio(sezione_di_ogni_concio.SegmentIDs)
regole_effettive_di_assegnazione_delle_s = RegoleEffettiveDiAssegnazioneDelleSezioniAiConci(sezione_di_ogni_concio.Schedule)
dimensioni_effettive_di_ciascuna_sezione = DimensioniEffettiveDiCiascunaSezioneMm(sezione_di_ogni_concio.ResolvedTable)
quota_ala_superiore_rispetto_al_baricent = QuotaAlaSuperioreRispettoAlBaricentroPerConcioMm(sezione_di_ogni_concio.TopOffsets)
diagnostica_sezioni_e_aggiornamento_tabe = DiagnosticaSezioniEAggiornamentoTabellaConci(sezione_di_ogni_concio.Information)
proprietà_famiglia_1 = BridgeSectionSchedule(
    Property=traversi_pieni.Property_2,
    Start=famiglia_1_inizio_assegnazione_mm,
    End=campate_e_tracciato.Length,
    Family=codice_famiglia_1,
    Group=proprietà_famiglia_1_group,
    Segment=proprietà_famiglia_1_segment,
    StartScale=proprietà_famiglia_1_start_scale,
    EndScale=proprietà_famiglia_1_end_scale)
proprietà_famiglia_2 = BridgeSectionSchedule(
    Property=correnti.Property_2,
    Start=famiglia_2_inizio_assegnazione_mm,
    End=campate_e_tracciato.Length,
    Family=codice_famiglia_2,
    Group=proprietà_famiglia_2_group,
    Segment=proprietà_famiglia_2_segment,
    StartScale=proprietà_famiglia_2_start_scale,
    EndScale=proprietà_famiglia_2_end_scale)
proprietà_famiglia_3 = BridgeSectionSchedule(
    Property=correnti.Property_2,
    Start=famiglia_3_inizio_assegnazione_mm,
    End=campate_e_tracciato.Length,
    Family=codice_famiglia_3,
    Group=proprietà_famiglia_3_group,
    Segment=proprietà_famiglia_3_segment,
    StartScale=proprietà_famiglia_3_start_scale,
    EndScale=proprietà_famiglia_3_end_scale)
proprietà_famiglia_4 = BridgeSectionSchedule(
    Property=montanti.Property_2,
    Start=famiglia_4_inizio_assegnazione_mm,
    End=campate_e_tracciato.Length,
    Family=codice_famiglia_4,
    Group=proprietà_famiglia_4_group,
    Segment=proprietà_famiglia_4_segment,
    StartScale=proprietà_famiglia_4_start_scale,
    EndScale=proprietà_famiglia_4_end_scale)
proprietà_famiglia_5 = BridgeSectionSchedule(
    Property=diagonali.Property_2,
    Start=famiglia_5_inizio_assegnazione_mm,
    End=campate_e_tracciato.Length,
    Family=codice_famiglia_5,
    Group=proprietà_famiglia_5_group,
    Segment=proprietà_famiglia_5_segment,
    StartScale=proprietà_famiglia_5_start_scale,
    EndScale=proprietà_famiglia_5_end_scale)
proprietà_famiglia_6 = BridgeSectionSchedule(
    Property=diagonali.Property_2,
    Start=famiglia_6_inizio_assegnazione_mm,
    End=campate_e_tracciato.Length,
    Family=codice_famiglia_6,
    Group=proprietà_famiglia_6_group,
    Segment=proprietà_famiglia_6_segment,
    StartScale=proprietà_famiglia_6_start_scale,
    EndScale=proprietà_famiglia_6_end_scale)
proprietà_famiglia_7 = BridgeSectionSchedule(
    Property=montanti.Property_2,
    Start=famiglia_7_inizio_assegnazione_mm,
    End=campate_e_tracciato.Length,
    Family=codice_famiglia_7,
    Group=proprietà_famiglia_7_group,
    Segment=proprietà_famiglia_7_segment,
    StartScale=proprietà_famiglia_7_start_scale,
    EndScale=proprietà_famiglia_7_end_scale)
carpenteria_fem_per_famiglia = BridgeMemberAssignment(
    BridgeGeometry=geometria_con_senza_controventi,
    DefaultProperties=travi_principali.Property_2,
    Families=famiglia_proprietà_di_base_1_tutte_le_fa,
    Schedule=flatten([sezione_di_ogni_concio.Schedule, proprietà_famiglia_1, proprietà_famiglia_2, proprietà_famiglia_3, proprietà_famiglia_4, proprietà_famiglia_5, proprietà_famiglia_6, proprietà_famiglia_7]))  # -> Beams, PhysicalIDs, Unassigned, Information
elementi_fem_carpenteria = ElementiFEMCarpenteria(carpenteria_fem_per_famiglia.Beams)
id_fisici_carpenteria = IDFisiciCarpenteria(carpenteria_fem_per_famiglia.PhysicalIDs)
assi_privi_di_proprietà_deve_essere_vuot = AssiPriviDiProprietàDeveEssereVuoto(carpenteria_fem_per_famiglia.Unassigned)
modello_sola_carpenteria = BuildModel(
    Elements=flatten([carpenteria_fem_per_famiglia.Beams, appoggi_orientati.Nodes]),
    Name=modello_sola_carpenteria_nome_modello,
    Units=modello_sola_carpenteria_unità_del_model,
    LoadCombinations=modello_sola_carpenteria_load_combinatio,
    StagedConstructions=modello_sola_carpenteria_staged_construc)
modello_acciaio_base_per_fasi_di_getto = MODELLOACCIAIOBasePerFasiDiGetto(modello_sola_carpenteria)
modello_graticcio_con_soletta = BuildModel(
    Elements=flatten([carpenteria_fem_per_famiglia.Beams, appoggi_orientati.Nodes, fasce_soletta_fem.Beams, collegamenti_eccentrici_trave_soletta.Elements]),
    Name=modello_graticcio_con_soletta_nome_model,
    Units=modello_graticcio_con_soletta_unità_del,
    LoadCombinations=modello_graticcio_con_soletta_load_combi,
    StagedConstructions=modello_graticcio_con_soletta_staged_con)
modello_graticcio_ingresso_per_straus = MODELLOGRATICCIOIngressoPerStraus(modello_graticcio_con_soletta)
entità_fem_assemblate = DecomposeModel(Model=modello_graticcio_con_soletta)  # -> Nodes, Beams, Plates
tutti_i_nodi_fem_assemblati = TuttiINodiFEMAssemblati(entità_fem_assemblate.Nodes)
tutti_gli_elementi_beam_assemblati = TuttiGliElementiBeamAssemblati(entità_fem_assemblate.Beams)
controllo_connessioni_e_proprietà = BridgeModelAudit(
    Model=modello_graticcio_con_soletta,
    Tolerance=tolleranza_audit_del_modello_mm,
    BridgeGeometry=controllo_connessioni_e_proprietà_bridge,
    PhaseModels=controllo_connessioni_e_proprietà_phase)  # -> NoInputErrors, Severity, Code, Element, Description, Model
audit_assenza_errori_negli_input = AuditAssenzaErroriNegliInput(controllo_connessioni_e_proprietà.NoInputErrors)
codici_diagnostici = CodiciDiagnostici(controllo_connessioni_e_proprietà.Code)
descrizione_diagnostica_del_modello = DescrizioneDiagnosticaDelModello(controllo_connessioni_e_proprietà.Description)
preview_del_graticcio = PreviewBridGHeModel(ModelElements=modello_graticcio_con_soletta, Settings=opzioni_preview)

# ---- group: 07 | Soletta e armature per il successivo verificatore
larghezza_efficace_soletta_per_singola_t = Slider(3500, range=500..10000)  # "Larghezza efficace soletta per singola trave [mm]"
area_totale_armatura_superiore_sulla_lar = Slider(3500, range=0..15000)  # "Area totale armatura superiore sulla larghezza efficace [mm²]"
distanza_asse_armatura_superiore_dall_es = Slider(50, range=10..150)  # "Distanza asse armatura superiore dall'estradosso [mm]"
area_totale_armatura_inferiore_sulla_lar = Slider(3500, range=0..15000)  # "Area totale armatura inferiore sulla larghezza efficace [mm²]"
distanza_asse_armatura_inferiore_dall_in = Slider(50, range=10..150)  # "Distanza asse armatura inferiore dall'intradosso [mm]"

# ----
sezione_soletta_per_il_misto = ConcreteSlabSection(
    Height=spessore_soletta_mm,
    Width=larghezza_efficace_soletta_per_singola_t,
    RebarArea=area_totale_armatura_superiore_sulla_lar,
    TopConcreteCover=distanza_asse_armatura_superiore_dall_es,
    BottomRebarArea=area_totale_armatura_inferiore_sulla_lar,
    BottomConcreteCover=distanza_asse_armatura_inferiore_dall_in)
soletta_con_due_file_di_armature_per_sez = SolettaConDueFileDiArmaturePerSezioneMista(sezione_soletta_per_il_misto)
