# Grasshopper definition flusso-acciaio-misto_REV002.ghx (Grasshopper 1.0.8)
# plug-ins: BridGHe

larghezza_piattabanda_superiore = Slider(600, range=0..1000)
larghezza_piattabanda_inferiore = Slider(800, range=0..1000)
spessore_piattabanda_superiore = Slider(30, range=0..100)
spessore_piattabanda_inferiore = Slider(40, range=0..100)
spessore_anima = Slider(15, range=0..100)
altezza = Slider(1800, range=0..10000)

larghezza_soletta_collaborante = Slider(2500, range=0..10000)
diametro_armatura_superiore = Slider(16, range=10..32)
diametro_armatura_inferiore = Slider(16, range=10..32)
passo_armatura_superiore_cm = Slider(10, range=10..25)
passo_armatura_inferiore_cm = Slider(10, range=10..25)
copriferro_superiore_mm = Slider(50, range=0..100)
copriferro_inferiore_mm = Slider(50, range=0..100)
altezza_soletta = Slider(300, range=0..1000)

i_section = ISection(
    BottomFlangeWidth=larghezza_piattabanda_inferiore,
    TopFlangeWidth=larghezza_piattabanda_superiore,
    Height=altezza,
    BottomFlangeThickness=spessore_piattabanda_inferiore,
    TopFlangeThickness=spessore_piattabanda_superiore,
    WebThickness=spessore_anima,
    Radius=0)

# ----
# Input Curve della travata
_12_elementi_2_campate_da_12000_mm = Curve([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])

# ----
# COME USARE: REV002 | Estensione del file personale 99. Analisi Straus memorizzate.
# Dopo modifiche: Run sulle 4 analisi; Run Excel in lettura; Run Build; Run Super Element Check; Generate Report.
# Geometria, coefficienti e ipotesi sono modificabili. Questa è una prova del flusso, non una combinazione normativa automatica.
panel = Panel("C32/40")

# ----
# Nodo Iniziale
appoggio_fisso = Point(Point(0, 0, 0))

# ----
# Nodo Finale
appoggi_scorrevoli = Point([Point(12000, 0, 0), Point(24000, 0, 0)])

# ----
# Nodo Intermedi
nodi_intermedi_vincoli_fuori_piano = Point([Point(2000, 0, 0), Point(4000, 0, 0), Point(6000, 0, 0), Point(8000, 0, 0), Point(10000, 0, 0), Point(14000, 0, 0), Point(16000, 0, 0), Point(18000, 0, 0), Point(20000, 0, 0), Point(22000, 0, 0)])

concrete = Concrete(Name=panel, Grade=6)
steel = Steel(Name="S355", Grade=2)
cluster = Cluster(radius=diametro_armatura_superiore, A=larghezza_soletta_collaborante, B=passo_armatura_superiore_cm)
cluster_2 = Cluster(radius=diametro_armatura_inferiore, A=larghezza_soletta_collaborante, B=passo_armatura_inferiore_cm)
group = Group("Travi Principali::Trave 1")
node = Node(Point=appoggio_fisso)
node_2 = Node(Point=appoggi_scorrevoli)
node_3 = Node(Point=nodi_intermedi_vincoli_fuori_piano)
tx_ty_tz = TxTyTz([True, True, True])
rx_ry_rz = RxRyRz([True, False, True])
tx_ty_tz_2 = TxTyTz([False, True, True])
rx_ry_rz_2 = RxRyRz([True, False, True])
tx_ty_tz_3 = TxTyTz([False, True, False])
rx_ry_rz_3 = RxRyRz([True, False, True])
restraints = Restraints(Node=node, Transational=tx_ty_tz, Rotation=rx_ry_rz)
restraints_2 = Restraints(Node=node_2, Transational=tx_ty_tz_2, Rotation=rx_ry_rz_2)
restraints_3 = Restraints(Node=node_3, Transational=tx_ty_tz_3, Rotation=rx_ry_rz_3)
due_facce_esposte = Panel("2")
multiplication = Multiplication(A=larghezza_soletta_collaborante, B=altezza_soletta)
multiplication_2 = Multiplication(A=larghezza_soletta_collaborante, B=due_facce_esposte)
# Ipotesi temporali: C32/40; RH70%; cemento N; 365 giorni. Fine cura e attivazione del misto a 7 giorni.
# Ac e perimetro da larghezza/spessore; due facce esposte, bordi trascurati.
# La stessa epsilon incrementale alimenta FEM e autotensioni. n ritiro = n a lungo termine in questo esempio.
ritiro_da_rh_geometria_ed_età = CreepAndShrinkageConcrete(
    Fck=32,
    ElasticModulusSteel=210000,
    ConcreteArea=multiplication,
    RH_=70,
    U_mm=multiplication_2,
    T0_days=28,
    T_days=365,
    CementType=1,
    DryingStart=7,
    ReferenceAge=7)  # -> N0, N, YTT0, Εcs, TotalShrinkage, DryingShrinkage, AutogenousShrinkage, NotionalSize

# ---- group: SEZIONE UNICA - proprietà di fase
b450 = B450(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)
concrete_slab_section = ConcreteSlabSection(
    Height=altezza_soletta,
    Width=larghezza_soletta_collaborante,
    RebarArea=cluster,
    TopConcreteCover=copriferro_superiore_mm,
    BottomRebarArea=cluster_2,
    BottomConcreteCover=copriferro_inferiore_mm)
n0 = Panel("7")
n_infinito = Panel("18")
n_ritiro = Panel("12")
epsilon_ritiro = Panel("-0.00020000000000000001")
composite_beam_property = CompositeBeamProperty(
    Name="H1800 600x30 800x40 anima15 + soletta 2500x300",
    ConcreteSlabSection=concrete_slab_section,
    SteelSection=i_section,
    ConcreteMaterial=concrete,
    SteelMaterial=steel,
    ReinforcementMaterial=b450,
    N0=ritiro_da_rh_geometria_ed_età.N0,
    N=ritiro_da_rh_geometria_ed_età.N,
    NRitiro=ritiro_da_rh_geometria_ed_età.N,
    ConsiderRebars=True)  # -> CompositeSection, OnlySteelProperty, N0BeamSection, NBeamSection, NRitiroBeamSection
composite_shrinkage_actions = CompositeShrinkageActions(CompositeProperty=composite_beam_property.CompositeSection, ConcreteStrain=ritiro_da_rh_geometria_ed_età.Εcs)  # -> StrausPreStrain, Axis2ThermalGradient, FreeCentroidStrain, FreeCurvature

# ----
beam = Beam(Line=_12_elementi_2_campate_da_12000_mm, Property=composite_beam_property.OnlySteelProperty, Groups=group, Angle=0)
beam_output_stations = BeamOutputStations(Beam=beam, OutputStations=Slider(4, range=0..10))
super_element = SuperElement(Element=beam_output_stations, Name="SE_Travata 1")
list_length = ListLength(List=super_element)
series = Series(Start=1, Step=1, Count=list_length)
element_id = ElementId(Element=super_element, ID=series)
merge = Merge(Data1=flatten(element_id), Data2=flatten(restraints), Data3=flatten(restraints_2), Data4=flatten(restraints_3))
build_model = BuildModel(Elements=merge, Name="Base - solo acciaio", Units=2)

# ----
# Model Check
bridge_model_audit = BridgeModelAudit(Model=build_model, Tolerance=1e-06)  # -> NoInputErrors, Severity, Code, Element, Description, Model
panel_2 = Panel(bridge_model_audit.Description)

decompose_model = DecomposeModel(Model=build_model)  # -> Nodes, Beams, Plates
beam_filter = BeamFilter(Beams=decompose_model.Beams, Units=2, Groups=group)  # -> Beams, Others

# ---- group: FASE 2
panel_3 = Panel("""G2_SOLETTA
G2_FINITURE
G2_BARRIERE""")
list_item = ListItem(List=panel_3, Index=0, Wrap=True)  # -> Item, Item1, Item2
modello_2 = Panel("G2_PERMANENTI | n infinito = 18")
beam_override = BeamOverride(Beam=beam_filter.Beams, Property=composite_beam_property.NBeamSection)  # -> simplify(graft(Beam))
load_case = LoadCase(Name=list_item.Item, GravityNSM=False)
load_case_2 = LoadCase(Name=list_item.Item1, GravityNSM=False)
load_case_3 = LoadCase(Name=list_item.Item2, GravityNSM=False)
beam_distributed_load = BeamDistributedLoad(Beam=simplify(beam_override), LoadCase=load_case, Type=0, Direction=1, PA=Slider(-10, range=-10..10), A=0, B=0)
beam_distributed_load_2 = BeamDistributedLoad(Beam=beam_distributed_load, LoadCase=load_case_2, Type=0, Direction=1, PA=Slider(-2, range=-10..10), A=0, B=0)
beam_distributed_load_3 = BeamDistributedLoad(Beam=beam_distributed_load_2, LoadCase=load_case_3, Type=0, Direction=1, PA=Slider(-1, range=-10..10), A=0, B=0)
list_length_2 = ListLength(List=panel_3)
merge_2 = Merge(Data1=load_case, Data2=load_case_2, Data3=load_case_3)
duplicate_data = DuplicateData(Data=1, Number=list_length_2, Order=True)
# C:\Users\g.pacini\Documents\Repository\BridGHe\example\99-Ponte completo GPC\Straus File\F2.st7
load_combination = LoadCombination(Name="G2_PERMANENTI", LoadCases=merge_2, Coefficients=duplicate_data)
build_model_2 = BuildModel(
    Elements=flatten([beam_distributed_load_3, decompose_model.Nodes]),
    Name="G2_PERMANENTI",
    Units=2,
    LoadCombinations=load_combination)
straus_r3_analysis = StrausR3Analysis(
    Model=build_model_2,
    Solver=0,
    AnalysisResults="G2_PERMANENTI",
    OutputPath="C:\Users\g.pacini\Documents\Repository\BridGHe\example\99-Ponte completo GPC\REV002\calcoli\G2.st7",
    KeepRunning=False,
    ElementGuids="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")

# ---- group: FASE 3
modello_3 = Panel("Q_TRAFFICO | n0 = 7")
beam_override_2 = BeamOverride(Beam=beam_filter.Beams, Property=composite_beam_property.N0BeamSection)
load_case_4 = LoadCase(Name="Q_TRAFFICO", GravityNSM=False)
load_case_5 = LoadCase(Name="WIND_1", GravityNSM=False)
beam_distributed_load_4 = BeamDistributedLoad(Beam=beam_override_2, LoadCase=load_case_4, Type=0, Direction=1, PA=Slider(-10, range=-10..10), A=0, B=0)
beam_distributed_load_5 = BeamDistributedLoad(Beam=beam_distributed_load_4, LoadCase=load_case_5, Type=0, Direction=0, PA=Slider(-5, range=-10..10), A=0, B=0)
build_model_3 = BuildModel(Elements=flatten([beam_distributed_load_5, decompose_model.Nodes]), Name="Q_TRAFFICO", Units=2)
results = ValueList({"Dead", "Q_TRAFFICO", "WIND_1"}, selected=["Q_TRAFFICO", "WIND_1"])
straus_r3_analysis_2 = StrausR3Analysis(
    Model=build_model_3,
    Solver=0,
    AnalysisResults=["Q_TRAFFICO", "WIND_1"],
    OutputPath="C:\Users\g.pacini\Documents\Repository\BridGHe\example\99-Ponte completo GPC\REV002\calcoli\Q.st7",
    KeepRunning=False,
    ElementGuids="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")

# ----
calcola_4_modelli_straus = BooleanToggle(False)

# ---- group: FASE 1
modello_1 = Panel("G1_GETTO | solo acciaio")
load_case_6 = LoadCase(Name="G1_GETTO", GravityNSM=False)
beam_distributed_load_6 = BeamDistributedLoad(Beam=beam_filter.Beams, LoadCase=load_case_6, Type=0, Direction=1, PA=Slider(-10, range=-10..10), A=0, B=0)
# C:\Users\g.pacini\Documents\Repository\BridGHe\example\99-Ponte completo GPC\Straus File\F1.st7
build_model_4 = BuildModel(Elements=flatten([beam_distributed_load_6, decompose_model.Nodes]), Name="G1_GETTO", Units=2)
straus_r3_analysis_3 = StrausR3Analysis(
    Model=build_model_4,
    Solver=0,
    AnalysisResults="G1_GETTO",
    OutputPath="C:\Users\g.pacini\Documents\Repository\BridGHe\example\99-Ponte completo GPC\REV002\calcoli\G1.st7",
    KeepRunning=False,
    ElementGuids="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")

# ----
# Preview Model Fase 0
display_settings = DisplaySettings(
    Enabled=True,
    Geometry=True,
    Sections=True,
    Shaded=True,
    Reinforcement=True,
    Loads=False,
    Supports=True,
    Releases=True,
    OtherAttributes=True,
    Axes=False,
    Labels=False,
    SymbolScale=1,
    LoadScale=1,
    Transparency=0.65)
preview_bridghe_model = PreviewBridGHeModel(ModelElements=build_model_4, Settings=display_settings)

results_2 = ValueList({"Dead", "RITIRO_FEM_GRAD", "RITIRO_FEM_LIN", "RITIRO_FEM"}, selected="RITIRO_FEM")

# ---- group: FASE 4
modello_4 = Panel("RITIRO_FEM | n ritiro = 12")
beam_override_3 = BeamOverride(Beam=beam_filter.Beams, Property=composite_beam_property.NRitiroBeamSection)
load_case_7 = LoadCase(Name="RITIRO_FEM_LIN", GravityNSM=False)
load_case_8 = LoadCase(Name="RITIRO_FEM_GRAD", GravityNSM=False)
load_case_9 = LoadCase(Name="RITIRO_PRIMARIO", GravityNSM=False)
merge_3 = Merge(Data1=load_case_7, Data2=load_case_8)
list_length_3 = ListLength(List=panel_3)
duplicate_data_2 = DuplicateData(Data=1, Number=list_length_3, Order=True)
load_combination_2 = LoadCombination(Name="RITIRO_FEM", LoadCases=merge_3, Coefficients=duplicate_data_2)
beam_preload = BeamPreLoad(Beam=beam_override_3, LoadCase=load_case_7, Type=1, Value=composite_shrinkage_actions.StrausPreStrain)
beam_gradient_load = BeamGradientLoad(Beam=beam_preload, LoadCase=load_case_8, Axis1=0, Axis2=composite_shrinkage_actions.Axis2ThermalGradient)
build_model_5 = BuildModel(
    Elements=flatten([beam_gradient_load, decompose_model.Nodes]),
    Name="RITIRO_FEM",
    Units=2,
    LoadCombinations=load_combination_2)
straus_r3_analysis_4 = StrausR3Analysis(
    Model=build_model_5,
    Solver=0,
    AnalysisResults=results_2,
    OutputPath="C:\Users\g.pacini\Documents\Repository\BridGHe\example\99-Ponte completo GPC\REV002\calcoli\RITIRO.st7",
    KeepRunning=False,
    ElementGuids="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")

# ----
# Preview Model Fase 1
display_settings_2 = DisplaySettings(
    Enabled=True,
    Geometry=True,
    Sections=True,
    Shaded=True,
    Reinforcement=True,
    Loads=False,
    Supports=True,
    Releases=True,
    OtherAttributes=True,
    Axes=False,
    Labels=False,
    SymbolScale=1,
    LoadScale=1,
    Transparency=0.65)
preview_bridghe_model_2 = PreviewBridGHeModel(ModelElements=build_model_2, Settings=display_settings_2)

super_element_filter = SuperElementFilter(BridGHeModel=straus_r3_analysis_3, SuperElement="SE_Travata 1")
super_element_filter_2 = SuperElementFilter(BridGHeModel=straus_r3_analysis, SuperElement="SE_Travata 1")
super_element_filter_3 = SuperElementFilter(BridGHeModel=straus_r3_analysis_2, SuperElement="SE_Travata 1")
value_list = ValueList({"G2_PERMANENTI"}, selected="G2_PERMANENTI")
build_model_6 = BuildModel(Elements=flatten(super_element_filter), Units=2)
build_model_7 = BuildModel(Elements=flatten(super_element_filter_2), Units=2)
build_model_8 = BuildModel(Elements=flatten(super_element_filter_3), Units=2)
value_list_2 = ValueList({"Only Steel": 0, "Long Term": 1, "Short Term": 2}, selected="Only Steel")
value_list_3 = ValueList({"Only Steel": 0, "Long Term": 1, "Short Term": 2}, selected="Long Term")
value_list_4 = ValueList({"Only Steel": 0, "Long Term": 1, "Short Term": 2}, selected="Short Term")
value_list_5 = ValueList({"Only Steel": 0, "Long Term": 1, "Short Term": 2}, selected="Long Term")
value_list_6 = ValueList({"Q_TRAFFICO", "WIND_1"}, selected="Q_TRAFFICO")
value_list_7 = ValueList({"RITIRO_FEM"}, selected="RITIRO_FEM")
value_list_8 = ValueList({"G1_GETTO"}, selected="G1_GETTO")
panel_4 = Panel("RIT_P")
panel_5 = Panel("RIT_S")
panel_6 = Panel("-0.000035")

# ----
# Preview Model Fase 2
display_settings_3 = DisplaySettings(
    Enabled=True,
    Geometry=True,
    Sections=True,
    Shaded=True,
    Reinforcement=True,
    Loads=False,
    Supports=True,
    Releases=True,
    OtherAttributes=True,
    Axes=False,
    Labels=False,
    SymbolScale=1,
    LoadScale=1,
    Transparency=0.65)
preview_bridghe_model_3 = PreviewBridGHeModel(ModelElements=build_model_3, Settings=display_settings_3)

bridge_shrinkage_action = BridgeShrinkageAction(
    ActionID="RITIRO",
    Model=straus_r3_analysis_4,
    Case="RITIRO_FEM",
    StrainIncrement=ritiro_da_rh_geometria_ed_età.Εcs,
    PrimaryOnly=False,
    Response=0)
wind_dal_modello_q = BridgeAction(ActionID="WIND", Model=straus_r3_analysis_2, Case="WIND_1", Behavior=2)
bridge_action = BridgeAction(ActionID="G1", Model=straus_r3_analysis_3, Case=value_list_8, Behavior=value_list_2)
bridge_action_2 = BridgeAction(ActionID="G2", Model=straus_r3_analysis, Case=value_list, Behavior=value_list_3)
bridge_action_3 = BridgeAction(ActionID="Q", Model=straus_r3_analysis_2, Case=value_list_6, Behavior=value_list_4)
value_list_9 = ValueList({"Only Steel": 0, "Composite": 1, "Concrete Excluded": 2}, selected="Only Steel")
value_list_10 = ValueList({"Only Steel": 0, "Composite": 1, "Concrete Excluded": 2}, selected="Composite")
value_list_11 = ValueList({"Only Steel": 0, "Composite": 1, "Concrete Excluded": 2}, selected="Composite")
value_list_12 = ValueList({"Only Steel": 0, "Composite": 1, "Concrete Excluded": 2}, selected="Composite")
value_list_13 = ValueList({"Only Steel": 0, "Composite": 1, "Concrete Excluded": 2}, selected="Composite")
panel_7 = Panel("10")
panel_8 = Panel("20")
panel_9 = Panel("30")
panel_10 = Panel("21")
panel_11 = Panel("22")
bridge_phase = BridgePhase(Number=10, Name=value_list_8, SectionState=value_list_9, Actions=flatten(bridge_action))
bridge_phase_2 = BridgePhase(Number=20, Name=value_list, SectionState=value_list_10, Actions=flatten(bridge_action_2))
bridge_phase_3 = BridgePhase(Number=40, Name=value_list_6, SectionState=value_list_11, Actions=flatten([bridge_action_3, wind_dal_modello_q]))
# Limite verificatore N Mx Vy: WIND è calcolato in Straus ma il suo coefficiente è ZERO nelle combinazioni di verifica.
# Il verificatore GPC adottato rifiuta correttamente flessione deviata/taglio trasversale/torsione.
# Il vento richiede un percorso di verifica dedicato; non è coperto da questo report.
bridge_phase_4 = BridgePhase(Number=30, Name="Ritiro primario e secondario", SectionState=value_list_13, Actions=flatten(bridge_shrinkage_action))

# ----
# Preview Model Fase 3
display_settings_4 = DisplaySettings(
    Enabled=True,
    Geometry=True,
    Sections=True,
    Shaded=True,
    Reinforcement=True,
    Loads=False,
    Supports=True,
    Releases=True,
    OtherAttributes=True,
    Axes=False,
    Labels=False,
    SymbolScale=1,
    LoadScale=1,
    Transparency=0.65)
preview_bridghe_model_4 = PreviewBridGHeModel(ModelElements=build_model_5, Settings=display_settings_4)

path = Panel("C:\Users\g.pacini\Documents\Repository\BridGHe\example\99-Ponte completo GPC\Combo_REV002.xlsx")
# ORIGINE E FASE: Quattro fasi 10/20/30/40. Azioni G1, G2, RITIRO, Q e WIND.
# Il ritiro primario e secondario hanno un unico coefficiente. Nessun prefisso dipende dall'ordine dei modelli.
# Excel in lettura: Run; Build BridGHe Model: Run; Super Element Check: Run; Bridge Report: Generate.
merge_4 = Merge(
    Data1=flatten(straus_r3_analysis_3),
    Data2=flatten(straus_r3_analysis),
    Data3=flatten(straus_r3_analysis_2),
    Data4=flatten(straus_r3_analysis_4))
merge_5 = Merge(Data1=flatten(bridge_phase), Data2=flatten(bridge_phase_2), Data4=flatten(bridge_phase_4), Data5=flatten(bridge_phase_3))
bridge_phase_table = BridgePhaseTable(Phases=flatten([bridge_phase, bridge_phase_2, bridge_phase_4, bridge_phase_3]))  # -> Phases, Number, Name, Day, SectionState, ActionID, Behavior, Source, Case, Strain
bridge_combination_excel = BridgeCombinationExcel(
    Models=flatten([straus_r3_analysis_3, straus_r3_analysis, straus_r3_analysis_2, straus_r3_analysis_4]),
    Phases=flatten([bridge_phase, bridge_phase_2, bridge_phase_4, bridge_phase_3]),
    File="Combinazioni_REV002.xlsx",
    Mode=0,
    Rows=20,
    Overwrite=False)  # -> File, Table, ActionIDs, Summary
panel_12 = Panel(bridge_phase_table.SectionState)
# LIMITI DELL'ESEMPIO: Modello lineare a fasi incrementali, cls non fessurato.
# Combinazioni DEMO per esercitare il flusso; nessuna conformità normativa implicita.
# Verifiche locali di sezione, pioli e irrigiditori. Restano esclusi fatica, instabilità globale, sisma e progetto trasversale della soletta.
bridge_combination_excel_2 = BridgeCombinationExcel(
    Models=flatten([straus_r3_analysis_3, straus_r3_analysis, straus_r3_analysis_2, straus_r3_analysis_4]),
    Phases=flatten([bridge_phase, bridge_phase_2, bridge_phase_4, bridge_phase_3]),
    File="Combinazioni_REV002.xlsx",
    Mode=1,
    Rows=20,
    Overwrite=False)  # -> File, Table, ActionIDs, Summary
build_bridghe_model = BuildBridGHeModel(
    Models=flatten([straus_r3_analysis_3, straus_r3_analysis, straus_r3_analysis_2, straus_r3_analysis_4]),
    Phases=flatten([bridge_phase, bridge_phase_2, bridge_phase_4, bridge_phase_3]),
    Combinations=bridge_combination_excel_2.Table,
    Calculation=0,
    AdditionalPhaseMembers=False)  # -> Model, Phases, Diagnostics
panel_13 = Panel(build_bridghe_model.Diagnostics)
super_element_2 = ValueList({"SE_Travata 1"}, selected="SE_Travata 1")
super_element_filter_4 = SuperElementFilter(BridGHeModel=build_bridghe_model.Model, SuperElement=super_element_2)
display_settings_5 = DisplaySettings(
    Enabled=True,
    Geometry=True,
    Sections=True,
    Shaded=True,
    Reinforcement=True,
    Loads=False,
    Supports=True,
    Releases=True,
    OtherAttributes=True,
    Axes=False,
    Labels=False,
    SymbolScale=1,
    LoadScale=1,
    Transparency=0.65)
composite_beam = CompositeBeam(Beam=super_element_filter_4, SectionStart=composite_beam_property.CompositeSection)
preview_bridghe_model_5 = PreviewBridGHeModel(ModelElements=composite_beam, Settings=display_settings_5)
super_element_check = SuperElementCheck(
    BridGHeModel=build_bridghe_model.Model,
    SuperElementBeam=composite_beam,
    WebLocalInstability=False,
    TopFlangeLocalInstability=False,
    BottomFlangeLocalInstability=False)  # -> TensionCheck, TauB, TensionForces
panel_14 = Panel("C:\Temp\diagramma.png")
composite_section_linear_tension_results = CompositeSectionLinearTensionResults(LinearTensionResults=super_element_check.TensionCheck)  # -> Point1_ConcreteEpsilon, Point1_ConcreteSigma, Point2_RebarSigma, Point3_RebarSigma, Point4_ConcreteSigma, Point5_SteelSigma, Point6_SteelSigma, Point6_SteelTau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
bridge_stress_plot = BridgeStressPlot(
    BridGHeModel=build_bridghe_model.Model,
    SuperElementBeam=composite_beam,
    Results=super_element_check.TensionCheck,
    Quantity=3,
    ShowMinMaxCombo=True,
    GraphicTitle="Trave 1 - Tensioni acciaio sigma 5",
    KeepRunning=True)  # -> SVG, File, Minimum, Maximum
bridge_force_plot = BridgeForcePlot(
    BridGHeModel=build_bridghe_model.Model,
    SuperElementBeam=composite_beam,
    Results=super_element_check.TensionForces,
    Quantity=4,
    ShowMinMaxCombo=True,
    GraphicTitle="Trave 1 - Momento Mx",
    KeepRunning=True)  # -> SVG, File, Minimum, Maximum
bridghe_panel = BridGHePanel()
sigma_cls_superiore_mpa = Panel(composite_section_linear_tension_results.Point1_ConcreteSigma)
sigma_armatura_superiore_mpa = Panel(composite_section_linear_tension_results.Point2_RebarSigma)
sigma_armatura_inferiore_mpa = Panel(composite_section_linear_tension_results.Point3_RebarSigma)
sigma_acciaio_inferiore_mpa = Panel(composite_section_linear_tension_results.Point8_SteelSigma)
bridge_plot_preview = BridgePlotPreview(SVG=flatten(bridge_stress_plot.SVG), Index=0, Width=600)
bridge_plot_preview_2 = BridgePlotPreview(SVG=flatten(bridge_force_plot.SVG), Index=0, Width=600)
intermedi_passo_2_m = Point([Point(2000, 0, 0), Point(4000, 0, 0), Point(6000, 0, 0), Point(8000, 0, 0), Point(10000, 0, 0), Point(14000, 0, 0), Point(16000, 0, 0), Point(18000, 0, 0), Point(20000, 0, 0), Point(22000, 0, 0)])
appoggi_sugli_assi_fem = Point([Point(0, 0, 0), Point(12000, 0, 0), Point(24000, 0, 0)])
list = ValueList({"Inviluppo WR di tutte le verifiche": 0, "Intermedio · rigidezza pannelli": 1, "Intermedio · stabilità e pressoflessione II ordine": 2, "Intermedio · freccia fuori piano": 3, "Intermedio · rigidezza torsionale": 4, "Intermedio · piatti entro classe 3": 5, "Intermedio · ingombro tra piattabande": 6, "Intermedio · saldature verticali all’anima": 7, "Intermedio · saldature alle flange": 8, "Intermedio · gola minima": 9, "Intermedio · lunghezza efficace cordone": 10, "Intermedio · collegamenti": 11}, selected="Inviluppo WR di tutte le verifiche")
list_2 = ValueList({"Inviluppo WR di tutte le verifiche": 0, "Appoggio · stabilità e pressoflessione II ordine": 1, "Appoggio · freccia fuori piano": 2, "Appoggio · rigidezza torsionale": 3, "Appoggio · piatti entro classe 3": 4, "Appoggio · ingombro tra piattabande": 5, "Appoggio · saldature verticali all’anima": 6, "Appoggio · saldature alle flange": 7, "Appoggio · gola minima": 8, "Appoggio · lunghezza efficace cordone": 9, "Appoggio · collegamenti": 10, "Appoggio · impronta trasversale sotto i piatti": 11, "Appoggio · impronta longitudinale": 12, "Appoggio · impronta entro l’estremità": 13, "Appoggio · contatto piatti/flangia": 14, "Terminale · due coppie bilaterali simmetriche": 15, "Terminale · area di ciascuna coppia": 16, "Terminale · distanza e > 0,1 hw": 17, "Terminale · e entro il pannello": 18, "Terminale · reazione e ancoraggio combinati": 19, "Seconda coppia terminale · stabilità e pressoflessione II ordine": 20, "Seconda coppia terminale · freccia fuori piano": 21, "Seconda coppia terminale · rigidezza torsionale": 22, "Seconda coppia terminale · piatti entro classe 3": 23, "Seconda coppia terminale · ingombro tra piattabande": 24, "Seconda coppia terminale · saldature verticali all’anima": 25, "Seconda coppia terminale · saldature alle flange": 26, "Seconda coppia terminale · gola minima": 27, "Seconda coppia terminale · lunghezza efficace cordone": 28, "Seconda coppia terminale · collegamenti": 29}, selected="Inviluppo WR di tutte le verifiche")
intermedi_200x20_pannelli2m = BridgeIntermediateStiffener(
    Enabled=True,
    Layout=0,
    Width=200,
    Thickness=20,
    RightWidth=200,
    RightThickness=20,
    LeftPanel=2000,
    RightPanel=4000,
    EqualPanels=True,
    LengthFactor=1,
    ExternalCompressionKN=0,
    LoadX=0,
    CheckWelds=True,
    WeldThroat=6)
pioli_2x22_passo200 = BridgeStuds(
    Enabled=True,
    CountPerRow=2,
    Diameter=22,
    Height=180,
    LongitudinalPitch=200,
    TransversePitch=150,
    Fu=450,
    GammaV=1.25,
    HeadDiameter=35,
    HeadThickness=10,
    RequiredCover=40,
    RepeatedActionDetail=True)
value_list_14 = ValueList({"Completa": 0, "Trave e stazione": 1, "Combinazione": 2, "Fase": 3}, selected="Completa")
ultimate_solo_dimostrazione = BridgeAnalysisOptions(
    Standard=1,
    LimitState=0,
    Class4=True,
    TopFlangeBuckling=True,
    BottomFlangeBuckling=True,
    WebBuckling=True,
    CommonLoadY=0,
    GammaM0=1.05,
    GammaM1=1.1,
    GammaM2=1.25,
    GammaC=1.5,
    GammaS=1.15,
    AlphaCC=0.85,
    ShearEta=1.2)
pioli_sulle_azioni_di_fase = BridgeDetailCheck(SectionResult=super_element_check.TensionCheck, Studs=pioli_2x22_passo200, Options=ultimate_solo_dimostrazione)  # -> SectionResult, Check, Demand, Resistance, Units, Ratio, Status, Warnings
sezioni_irrigiditori_intermedi = BridgeDetailStations(
    Model=build_bridghe_model.Model,
    Results=pioli_sulle_azioni_di_fase.SectionResult,
    Locations=intermedi_passo_2_m,
    Up=Vector(0, 0, 1),
    Tolerance=1e-06)  # -> Results, CompressionKN, SignedReactionKN, EndType, Points
appoggi_e_reazioni_reali = BridgeDetailStations(
    Model=build_bridghe_model.Model,
    Results=pioli_sulle_azioni_di_fase.SectionResult,
    Locations=appoggi_sugli_assi_fem,
    Phases=[bridge_phase, bridge_phase_2, bridge_phase_4, bridge_phase_3],
    Up=Vector(0, 0, 1),
    Tolerance=1e-06)  # -> Results, CompressionKN, SignedReactionKN, EndType, Points
appoggio_r_fem_per_combinazione = BridgeSupportStiffener(
    Enabled=True,
    Layout=0,
    Width=200,
    Thickness=25,
    RightWidth=250,
    RightThickness=25,
    Location=appoggi_e_reazioni_reali.EndType,
    LeftPanel=2000,
    RightPanel=2000,
    ReactionKN=appoggi_e_reazioni_reali.CompressionKN,
    EndDistance=250,
    LoadX=0,
    LoadZ=0,
    FootprintLength=400,
    FootprintWidth=600,
    LengthFactor=1,
    RigidEndPost=False,
    EndPostSpacing=300,
    CheckWelds=True,
    WeldThroat=10)
verifica_intermedi = BridgeDetailCheck(SectionResult=sezioni_irrigiditori_intermedi.Results, IntermediateStiffener=intermedi_200x20_pannelli2m)  # -> SectionResult, Check, Demand, Resistance, Units, Ratio, Status, Warnings
verifica_agli_appoggi = BridgeDetailCheck(SectionResult=appoggi_e_reazioni_reali.Results, SupportStiffener=appoggio_r_fem_per_combinazione)  # -> SectionResult, Check, Demand, Resistance, Units, Ratio, Status, Warnings
intstiffplot = BridgeIntermediateStiffenerPlot(
    BridGHeModel=build_bridghe_model.Model,
    SuperElementBeam=composite_beam,
    Results=verifica_intermedi.SectionResult,
    Check=list,
    ShowMinMaxCombo=True,
    GraphicTitle="Trave 1 - Irrigiditori intermedi WR",
    KeepRunning=True,
    Display=0,
    Stations=[2, 4, 6, 8, 10, 14, 16, 18, 20, 22])  # -> SVG, File, Minimum, Maximum, GoverningChecks, UnavailableChecks
supstiffplot = BridgeSupportStiffenerPlot(
    BridGHeModel=build_bridghe_model.Model,
    SuperElementBeam=composite_beam,
    Results=verifica_agli_appoggi.SectionResult,
    Check=list_2,
    ShowMinMaxCombo=True,
    GraphicTitle="Trave 1 - Irrigiditori agli appoggi WR",
    KeepRunning=True,
    Display=0,
    Stations=[0, 12, 24])  # -> SVG, File, Minimum, Maximum, GoverningChecks, UnavailableChecks
studplot = BridgeStudPlot(
    BridGHeModel=build_bridghe_model.Model,
    SuperElementBeam=composite_beam,
    Results=pioli_sulle_azioni_di_fase.SectionResult,
    Quantity=5,
    ShowMinMaxCombo=True,
    GraphicTitle="Trave 1 - Pioli Ed e Rd",
    KeepRunning=True)  # -> SVG, File, Minimum, Maximum
plotpreview = BridgePlotPreview(SVG=flatten(studplot.SVG), Index=0, Width=600)
plotpreview_2 = BridgePlotPreview(SVG=flatten(intstiffplot.SVG), Index=0, Width=600)
plotpreview_3 = BridgePlotPreview(SVG=flatten(supstiffplot.SVG), Index=0, Width=600)
bridge_result_labels = BridgeResultLabels(Results=pioli_sulle_azioni_di_fase.SectionResult, Format=value_list_14)
pioli_per_stazione_e_combo = BridgeStudResults(SectionResult=pioli_sulle_azioni_di_fase.SectionResult)  # -> ConnectionFlow, ForcePerStud, ResistancePerStud, ResistancePerLength, ForceRatio, Phase, PhaseFlow, Warnings
tutti_gli_esiti_locali = BridgeCheckSummary(Results=[pioli_sulle_azioni_di_fase.SectionResult, verifica_intermedi.SectionResult, verifica_agli_appoggi.SectionResult])  # -> Label, Phase, Check, Ratio, Status, Units, Notes, MaximumFiniteRatio, UnavailableRatios, GoverningLabels
flusso_n_mm = Panel(pioli_per_stazione_e_combo.ConnectionFlow)
forza_per_piolo_kn = Panel(pioli_per_stazione_e_combo.ForcePerStud)
# PERCORSO E LIMITI: Pioli verificati per sezione/combinazione. Intermedi solo ai punti assegnati; appoggi a x=0/12/24 m.
# Le reazioni sono combinate dalle stesse fonti e dagli stessi coefficienti delle fasi. Sollevamento mantenuto con segno.
# Il modello deve essere ricalcolato prima di aggiornare le verifiche. Opzione Ultimate esplicita; coefficienti DEMO dichiarati nell'Excel.
rapporto_piolo = Panel(pioli_per_stazione_e_combo.ForceRatio)
capitoli = ValueList({"Modello": 0, "Sezioni e materiali": 1, "Fasi e combinazioni": 2, "Verifiche": 3, "Casi governanti": 4, "Grafici": 5, "Tabulato completo": 6}, selected=["Fasi e combinazioni", "Grafici"])
controlli = Panel(pioli_sulle_azioni_di_fase.Check)
# Sequenza finale: 1 Run Excel in lettura. 2 Run Build. 3 Run Super Element Check. 4 Generate Report.
# Pioli, intermedi e appoggi hanno rami distinti per conservare posizioni e reazioni.
# Per i grafici selezionare una verifica o l'inviluppo WR; le anteprime sono sul canvas.
riepilogo_controllo_governante_per_stazi = Panel(tutti_gli_esiti_locali.GoverningLabels)  # "Riepilogo — controllo governante per stazione"
report_completo_rev002 = BridgeReport(
    Results=[pioli_sulle_azioni_di_fase.SectionResult, verifica_intermedi.SectionResult, verifica_agli_appoggi.SectionResult],
    Template="Template_BridGHe.docx",
    File="Report_REV002.docx",
    Topics=capitoli,
    Model=build_bridghe_model.Model,
    Title="Verifiche del flusso ponte misto REV002",
    Project="Esempio 99 | 12 + 12 m | combinazioni DEMO | RH70% cemento N 7-365 giorni",
    Author="BridGHe",
    Revision="REV002",
    SVG=[bridge_force_plot.SVG, bridge_stress_plot.SVG, studplot.SVG, intstiffplot.SVG, supstiffplot.SVG],
    Overwrite=False)  # -> File, Summary, Warnings, ReportID
rapporti_stesso_ordine = Panel(pioli_sulle_azioni_di_fase.Ratio)

# ==== cluster Cluster
radius = ClusterInput()
A = ClusterInput()
B = ClusterInput()
circle = Circle(Plane=PlaneXY(0, 0, 0), Radius=expr("x/2", radius))
division = Division(A=A, B=B)
multiplication = Multiplication(A=division, B=0.1)
area = Area(Geometry=circle)  # -> Area, Centroid
multiplication_2 = Multiplication(A=area.Area, B=multiplication)
result = ClusterOutput(multiplication_2)
