# Grasshopper definition flusso-acciaio-misto_REV001.ghx (Grasshopper 1.0.8)
# plug-ins: BridGHe

larghezza_piattabanda_superiore = Slider(600, range=0..1000)
larghezza_piattabanda_inferiore = Slider(800, range=0..1000)
spessore_piattabanda_superiore = Slider(30, range=0..100)
spessore_piattabanda_inferiore = Slider(40, range=0..100)
spessore_anima = Slider(15, range=0..100)
altezza = Slider(1800, range=0..10000)

larghezza_soletta_collaborante = Slider(2500, range=0..10000)
diametro_armatura_superiore = Slider(16, range=10..32)
diametro_armatura_inferiore = Slider(16, range=10..32)
passo_armatura_superiore_cm = Slider(10, range=10..25)
passo_armatura_inferiore_cm = Slider(10, range=10..25)
copriferro_superiore_mm = Slider(50, range=0..100)
copriferro_inferiore_mm = Slider(50, range=0..100)
altezza_soletta = Slider(300, range=0..1000)

i_section = ISection(
    BottomFlangeWidth=larghezza_piattabanda_superiore,
    TopFlangeWidth=larghezza_piattabanda_inferiore,
    Height=altezza,
    BottomFlangeThickness=spessore_piattabanda_superiore,
    TopFlangeThickness=spessore_piattabanda_inferiore,
    WebThickness=spessore_anima,
    Radius=0)

# ----
# Input Curve della travata
_12_elementi_2_campate_da_12000_mm = Curve([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])

# ----
# COME USARE: 01 | Un unico modello acciaio assemblato.
# 02 | Tre copie con Beam Override: n infinito, n0, n ritiro.
# 03 | Quattro analisi Straus incrementali; non sommare modelli già cumulativi.
# 04 | Merge ordinato e matching esplicito dei casi; poi assegnazione della sezione mista e verifica.
# Aprire: risultati Straus già memorizzati. Premere Run su Build BridGHe Model, poi Run su Super Element Check.
# Se si modificano input: CALCOLA = true, poi false, poi i due Run.
# Esempio didattico di trave continua a due campate 12 + 12 m, N-mm-MPa. Non è un progetto completo di ponte.
panel = Panel("C32/40")

# ----
# Nodo Iniziale
appoggio_fisso = Point(Point(0, 0, 0))

# ----
# Nodo Finale
appoggi_scorrevoli = Point([Point(12000, 0, 0), Point(24000, 0, 0)])

# ----
# Nodo Intermedi
nodi_intermedi_vincoli_fuori_piano = Point([Point(2000, 0, 0), Point(4000, 0, 0), Point(6000, 0, 0), Point(8000, 0, 0), Point(10000, 0, 0), Point(14000, 0, 0), Point(16000, 0, 0), Point(18000, 0, 0), Point(20000, 0, 0), Point(22000, 0, 0)])

concrete = Concrete(Name=panel, Grade=6)
steel = Steel(Name="S355", Grade=2)
cluster = Cluster(radius=diametro_armatura_superiore, A=larghezza_soletta_collaborante, B=passo_armatura_superiore_cm)
cluster_2 = Cluster(radius=diametro_armatura_inferiore, A=larghezza_soletta_collaborante, B=passo_armatura_inferiore_cm)

# ---- group: SEZIONE UNICA - proprietà di fase
b450 = B450(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)
concrete_slab_section = ConcreteSlabSection(
    Height=250,
    Width=3000,
    RebarArea=cluster,
    TopConcreteCover=copriferro_superiore_mm,
    BottomRebarArea=cluster_2,
    BottomConcreteCover=copriferro_inferiore_mm)
n0 = Panel("7")
n_infinito = Panel("18")
n_ritiro = Panel("12")
epsilon_ritiro = Panel("-0.00020000000000000001")
composite_beam_property = CompositeBeamProperty(
    Name="H1600 + soletta 3000x250",
    ConcreteSlabSection=concrete_slab_section,
    SteelSection=i_section,
    ConcreteMaterial=concrete,
    SteelMaterial=steel,
    ReinforcementMaterial=b450,
    N0=n0,
    N=n_infinito,
    ConsiderRebars=True,
    NRitiro=n_ritiro)  # -> CompositeSection, OnlySteelProperty, N0BeamSection, NBeamSection, NRitiroBeamSection
composite_shrinkage_actions = CompositeShrinkageActions(CompositeProperty=composite_beam_property.CompositeSection, ConcreteStrain=epsilon_ritiro)  # -> StrausPreStrain, Axis2ThermalGradient, FreeCentroidStrain, FreeCurvature

# ----
group = Group("Travi Principali::Trave 1")
beam = Beam(Line=_12_elementi_2_campate_da_12000_mm, Property=composite_beam_property.OnlySteelProperty, Groups=group, Angle=0)
node = Node(Point=appoggio_fisso)
node_2 = Node(Point=appoggi_scorrevoli)
node_3 = Node(Point=nodi_intermedi_vincoli_fuori_piano)
tx_ty_tz = TxTyTz([True, True, True])
rx_ry_rz = RxRyRz([True, False, True])
tx_ty_tz_2 = TxTyTz([False, True, True])
rx_ry_rz_2 = RxRyRz([True, False, True])
tx_ty_tz_3 = TxTyTz([False, True, False])
rx_ry_rz_3 = RxRyRz([True, False, True])
beam_output_stations = BeamOutputStations(Beam=beam, OutputStations=Slider(4, range=0..10))
restraints = Restraints(Node=node, Transational=tx_ty_tz, Rotation=rx_ry_rz)
restraints_2 = Restraints(Node=node_2, Transational=tx_ty_tz_2, Rotation=rx_ry_rz_2)
restraints_3 = Restraints(Node=node_3, Transational=tx_ty_tz_3, Rotation=rx_ry_rz_3)
super_element = SuperElement(Element=beam_output_stations, Name="SE_Travata 1")
list_length = ListLength(List=super_element)
series = Series(Start=1, Step=1, Count=list_length)
element_id = ElementId(Element=super_element, ID=series)
merge = Merge(Data1=flatten(element_id), Data2=flatten(restraints), Data3=flatten(restraints_2), Data4=flatten(restraints_3))
build_model = BuildModel(Elements=merge, Name="Base - solo acciaio", Units=2)

# ----
# Model Check
bridge_model_audit = BridgeModelAudit(Model=build_model, Tolerance=1e-06)  # -> NoInputErrors, Severity, Code, Element, Description, Model
panel_2 = Panel(bridge_model_audit.Description)

decompose_model = DecomposeModel(Model=build_model)  # -> Nodes, Beams, Plates
beam_filter = BeamFilter(Beams=decompose_model.Beams, Units=2, Groups=group)  # -> Beams, Others
calcola_4_modelli_straus = BooleanToggle(True)

# ---- group: FASE 3
modello_3 = Panel("Q_TRAFFICO | n0 = 7")
beam_override = BeamOverride(Beam=beam_filter.Beams, Property=composite_beam_property.N0BeamSection)
load_case = LoadCase(Name="Q_TRAFFICO", GravityNSM=False)
load_case_2 = LoadCase(Name="WIND_1", GravityNSM=False)
beam_distributed_load = BeamDistributedLoad(Beam=beam_override, LoadCase=load_case, Type=0, Direction=1, PA=Slider(-10, range=-10..10), A=0, B=0)
beam_distributed_load_2 = BeamDistributedLoad(Beam=beam_distributed_load, LoadCase=load_case_2, Type=0, Direction=0, PA=Slider(-5, range=-10..10), A=0, B=0)
build_model_2 = BuildModel(Elements=flatten([beam_distributed_load_2, decompose_model.Nodes]), Name="Q_TRAFFICO", Units=2)
results = ValueList({"Dead", "Q_TRAFFICO", "WIND_1"}, selected=["Q_TRAFFICO", "WIND_1"])
straus_r3_analysis = StrausR3Analysis(
    Model=build_model_2,
    Solver=0,
    AnalysisResults=results,
    OutputPath="C:\Users\g.pacini\Documents\Repository\BridGHe\example\19-flusso-acciaio-misto\archivio\REV001\calcoli\Q_TRAFFICO.st7",
    KeepRunning=calcola_4_modelli_straus,
    ElementGuids="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")

# ----
panel_3 = Panel("C:\Users\g.pacini\Documents\Repository\BridGHe\example\99-Ponte completo GPC\Straus File\F1.st7")

# ---- group: FASE 1
modello_1 = Panel("G1_GETTO | solo acciaio")
load_case_3 = LoadCase(Name="G1_GETTO", GravityNSM=False)
beam_distributed_load_3 = BeamDistributedLoad(Beam=beam_filter.Beams, LoadCase=load_case_3, Type=0, Direction=1, PA=Slider(-10, range=-10..10), A=0, B=0)
build_model_3 = BuildModel(Elements=flatten([beam_distributed_load_3, decompose_model.Nodes]), Name="G1_GETTO", Units=2)
straus_r3_analysis_2 = StrausR3Analysis(
    Model=build_model_3,
    Solver=0,
    AnalysisResults="G1_GETTO",
    OutputPath=panel_3,
    KeepRunning=calcola_4_modelli_straus,
    ElementGuids="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")

# ----
panel_4 = Panel("C:\Users\g.pacini\Documents\Repository\BridGHe\example\99-Ponte completo GPC\Straus File\F2.st7")

# ---- group: FASE 2
panel_5 = Panel("""G2_SOLETTA
G2_FINITURE
G2_BARRIERE""")
list_item = ListItem(List=panel_5, Index=0, Wrap=True)  # -> Item, Item1, Item2
modello_2 = Panel("G2_PERMANENTI | n infinito = 18")
beam_override_2 = BeamOverride(Beam=beam_filter.Beams, Property=composite_beam_property.NBeamSection)  # -> simplify(graft(Beam))
load_case_4 = LoadCase(Name=list_item.Item, GravityNSM=False)
load_case_5 = LoadCase(Name=list_item.Item1, GravityNSM=False)
load_case_6 = LoadCase(Name=list_item.Item2, GravityNSM=False)
beam_distributed_load_4 = BeamDistributedLoad(Beam=simplify(beam_override_2), LoadCase=load_case_4, Type=0, Direction=1, PA=Slider(-10, range=-10..10), A=0, B=0)
beam_distributed_load_5 = BeamDistributedLoad(Beam=beam_distributed_load_4, LoadCase=load_case_5, Type=0, Direction=1, PA=Slider(-2, range=-10..10), A=0, B=0)
beam_distributed_load_6 = BeamDistributedLoad(Beam=beam_distributed_load_5, LoadCase=load_case_6, Type=0, Direction=1, PA=Slider(-1, range=-10..10), A=0, B=0)
list_length_2 = ListLength(List=panel_5)
merge_2 = Merge(Data1=load_case_4, Data2=load_case_5, Data3=load_case_6)
duplicate_data = DuplicateData(Data=1, Number=list_length_2, Order=True)
load_combination = LoadCombination(Name="G2_PERMANENTI", LoadCases=merge_2, Coefficients=duplicate_data)
build_model_4 = BuildModel(
    Elements=flatten([beam_distributed_load_6, decompose_model.Nodes]),
    Name="G2_PERMANENTI",
    Units=2,
    LoadCombinations=load_combination)
straus_r3_analysis_3 = StrausR3Analysis(
    Model=build_model_4,
    Solver=0,
    AnalysisResults="G2_PERMANENTI",
    OutputPath=panel_4,
    KeepRunning=calcola_4_modelli_straus,
    ElementGuids="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")

# ----
# Preview Model Fase 0
display_settings = DisplaySettings(
    Enabled=True,
    Geometry=True,
    Sections=True,
    Shaded=True,
    Reinforcement=True,
    Loads=False,
    Supports=True,
    Releases=True,
    OtherAttributes=True,
    Axes=False,
    Labels=False,
    SymbolScale=1,
    LoadScale=1,
    Transparency=0.65)
preview_bridghe_model = PreviewBridGHeModel(ModelElements=build_model_3, Settings=display_settings)

results_2 = ValueList({"Dead", "RITIRO_FEM_GRAD", "RITIRO_FEM_LIN", "RITIRO_FEM"}, selected="RITIRO_FEM")

# ---- group: FASE 4
panel_6 = Panel("RITIRO_PRIMARIO")
modello_4 = Panel("RITIRO_FEM | n ritiro = 12")
beam_override_3 = BeamOverride(Beam=beam_filter.Beams, Property=composite_beam_property.NRitiroBeamSection)
load_case_7 = LoadCase(Name="RITIRO_FEM_LIN", GravityNSM=False)
load_case_8 = LoadCase(Name="RITIRO_FEM_GRAD", GravityNSM=False)
load_case_9 = LoadCase(Name=panel_6, GravityNSM=False)
merge_3 = Merge(Data1=load_case_7, Data2=load_case_8)
list_length_3 = ListLength(List=panel_5)
duplicate_data_2 = DuplicateData(Data=1, Number=list_length_3, Order=True)
load_combination_2 = LoadCombination(Name="RITIRO_FEM", LoadCases=merge_3, Coefficients=duplicate_data_2)
beam_preload = BeamPreLoad(Beam=beam_override_3, LoadCase=load_case_7, Type=1, Value=composite_shrinkage_actions.StrausPreStrain)
beam_gradient_load = BeamGradientLoad(Beam=beam_preload, LoadCase=load_case_8, Axis1=0, Axis2=composite_shrinkage_actions.Axis2ThermalGradient)
build_model_5 = BuildModel(
    Elements=flatten([beam_gradient_load, decompose_model.Nodes]),
    Name="RITIRO_FEM",
    Units=2,
    LoadCombinations=load_combination_2)
straus_r3_analysis_4 = StrausR3Analysis(
    Model=build_model_5,
    Solver=0,
    AnalysisResults=results_2,
    OutputPath="C:\Users\g.pacini\Documents\Repository\BridGHe\example\19-flusso-acciaio-misto\archivio\REV002\calcoli\RITIRO_FEM.st7",
    KeepRunning=calcola_4_modelli_straus,
    ElementGuids="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")

# ----
composite_beam_strain = CompositeBeamStrain(Beam=beam_override_3, LoadCase=load_case_9, Strain=epsilon_ritiro)

# ----
# Preview Model Fase 1
display_settings_2 = DisplaySettings(
    Enabled=True,
    Geometry=True,
    Sections=True,
    Shaded=True,
    Reinforcement=True,
    Loads=False,
    Supports=True,
    Releases=True,
    OtherAttributes=True,
    Axes=False,
    Labels=False,
    SymbolScale=1,
    LoadScale=1,
    Transparency=0.65)
preview_bridghe_model_2 = PreviewBridGHeModel(ModelElements=build_model_4, Settings=display_settings_2)

super_element_filter = SuperElementFilter(BridGHeModel=straus_r3_analysis_2, SuperElement="SE_Travata 1")
super_element_filter_2 = SuperElementFilter(BridGHeModel=straus_r3_analysis_3, SuperElement="SE_Travata 1")
super_element_filter_3 = SuperElementFilter(BridGHeModel=straus_r3_analysis, SuperElement="SE_Travata 1")
value_list = ValueList({"G2_PERMANENTI"}, selected="G2_PERMANENTI")
build_model_6 = BuildModel(Elements=flatten(super_element_filter), Units=2)
build_model_7 = BuildModel(Elements=flatten(super_element_filter_2), Units=2)
build_model_8 = BuildModel(Elements=flatten(super_element_filter_3), Units=2)
value_list_2 = ValueList({"Only Steel": 0, "Long Term": 1, "Short Term": 2}, selected="Only Steel")
value_list_3 = ValueList({"Only Steel": 0, "Long Term": 1, "Short Term": 2}, selected="Long Term")
value_list_4 = ValueList({"Only Steel": 0, "Long Term": 1, "Short Term": 2}, selected="Short Term")
value_list_5 = ValueList({"Only Steel": 0, "Long Term": 1, "Short Term": 2}, selected="Long Term")
value_list_6 = ValueList({"Q_TRAFFICO", "WIND_1"}, selected="Q_TRAFFICO")
value_list_7 = ValueList({"RITIRO_FEM"}, selected="RITIRO_FEM")
value_list_8 = ValueList({"G1_GETTO"}, selected="G1_GETTO")

# ----
# Preview Model Fase 2
display_settings_3 = DisplaySettings(
    Enabled=True,
    Geometry=True,
    Sections=True,
    Shaded=True,
    Reinforcement=True,
    Loads=False,
    Supports=True,
    Releases=True,
    OtherAttributes=True,
    Axes=False,
    Labels=False,
    SymbolScale=1,
    LoadScale=1,
    Transparency=0.65)
preview_bridghe_model_3 = PreviewBridGHeModel(ModelElements=build_model_2, Settings=display_settings_3)

bridge_shrinkage_action = BridgeShrinkageAction(ActionID="RIT_S", StrainIncrement="-0.000035", PrimaryOnly=invert(False), Response=0)
bridge_action = BridgeAction(ActionID="G1", Model=build_model_6, Case=value_list_8, Behavior=value_list_2)
bridge_action_2 = BridgeAction(ActionID="G2", Model=build_model_7, Case=value_list, Behavior=value_list_3)
bridge_action_3 = BridgeAction(ActionID="Q", Model=build_model_8, Case=value_list_6, Behavior=value_list_4)
bridge_action_4 = BridgeAction(ActionID="RIT_P", Model=straus_r3_analysis_4, Case=value_list_7, Behavior=value_list_5)
value_list_9 = ValueList({"Only Steel": 0, "Composite": 1, "Concrete Excluded": 2}, selected="Only Steel")
value_list_10 = ValueList({"Only Steel": 0, "Composite": 1, "Concrete Excluded": 2}, selected="Composite")
value_list_11 = ValueList({"Only Steel": 0, "Composite": 1, "Concrete Excluded": 2}, selected="Composite")
value_list_12 = ValueList({"Only Steel": 0, "Composite": 1, "Concrete Excluded": 2}, selected="Composite")
value_list_13 = ValueList({"Only Steel": 0, "Composite": 1, "Concrete Excluded": 2}, selected="Composite")
bridge_phase = BridgePhase(Number="10", Name=value_list_8, SectionState=value_list_9, Actions=bridge_action)
bridge_phase_2 = BridgePhase(Number="20", Name=value_list, SectionState=value_list_10, Actions=bridge_action_2)
bridge_phase_3 = BridgePhase(Number="30", Name=value_list_6, SectionState=value_list_11, Actions=bridge_action_3)
bridge_phase_4 = BridgePhase(Number="21", Name=value_list_7, SectionState=value_list_12, Actions=bridge_action_4)
bridge_phase_5 = BridgePhase(Number="22", Name=panel_6, SectionState=value_list_13, Actions=bridge_shrinkage_action)

# ----
# Preview Model Fase 3
display_settings_4 = DisplaySettings(
    Enabled=True,
    Geometry=True,
    Sections=True,
    Shaded=True,
    Reinforcement=True,
    Loads=False,
    Supports=True,
    Releases=True,
    OtherAttributes=True,
    Axes=False,
    Labels=False,
    SymbolScale=1,
    LoadScale=1,
    Transparency=0.65)
preview_bridghe_model_4 = PreviewBridGHeModel(ModelElements=build_model_5, Settings=display_settings_4)

path = Panel("C:\Users\g.pacini\Documents\Repository\BridGHe\example\99-Ponte completo GPC\Combo_REV002.xlsx")
# ORIGINE E FASE: REV002: matching delle fasi corretto.
# 4-RITIRO_FEM va nell'ultimo input, Phase n ritiro FEM Load Cases.
# 5-RITIRO_PRIMARIO va in Phase Ninf strain Load Cases.
# Il prefisso e quello dell'ordine dei cinque modelli nel merge.
# Combo_REV002.xlsx e invariato: manca la colonna 4-RITIRO_FEM, quindi le sue sollecitazioni non entrano nelle combinazioni attuali. Definirne i coefficienti per includerle.
# Risultati Straus memorizzati: CALCOLA=false; premere Run su Build BridGHe Model e Super Element Check.
merge_4 = Merge(
    Data1=flatten(straus_r3_analysis_2),
    Data2=flatten(straus_r3_analysis_3),
    Data3=flatten(straus_r3_analysis),
    Data4=flatten(straus_r3_analysis_4))
merge_5 = Merge(
    Data1=flatten(bridge_phase),
    Data2=flatten(bridge_phase_2),
    Data3=flatten(bridge_phase_4),
    Data4=flatten(bridge_phase_5),
    Data5=flatten(bridge_phase_3))
bridge_phase_table = BridgePhaseTable(Phases=merge_5)  # -> Phases, Number, Name, Day, SectionState, ActionID, Behavior, Source, Case, Strain
bridge_combination_excel = BridgeCombinationExcel(Models=merge_4, Phases=merge_5, File=path, Mode=0, Rows=20, Overwrite=invert(False))  # -> File, Table, ActionIDs, Summary
panel_7 = Panel(bridge_phase_table.SectionState)
# LIMITI DELL'ESEMPIO: Analisi lineari incrementali di una trave nel piano, soletta non fessurata.
# Tre fasi di carico + ritiro FEM + autotensione.
# Le fasi usano le stesse geometrie, ID, assi e vincoli.
# J è quello dell'acciaio, come nel componente precedente.
# Coefficienti unitari didattici: nessuna combinazione normativa è implicita.
# Tau b resta NaN; non usare questo output come verifica della connessione.
# Restano da definire SLU, fatica, pioli, instabilità, soletta trasversale e azioni orizzontali.
bridge_combination_excel_2 = BridgeCombinationExcel(Models=merge_4, Phases=merge_5, File=path, Mode=1, Rows=20, Overwrite=False)  # -> File, Table, ActionIDs, Summary
build_bridghe_model = BuildBridGHeModel(Models=merge_4, Phases=merge_5, Combinations=bridge_combination_excel_2.Table, Calculation=0)  # -> Model, Phases, Diagnostics
panel_8 = Panel(build_bridghe_model.Diagnostics)
super_element_2 = ValueList({"SE_Travata 1"}, selected="SE_Travata 1")
super_element_filter_4 = SuperElementFilter(BridGHeModel=build_bridghe_model.Model, SuperElement=super_element_2)
display_settings_5 = DisplaySettings(
    Enabled=True,
    Geometry=True,
    Sections=True,
    Shaded=True,
    Reinforcement=True,
    Loads=False,
    Supports=True,
    Releases=True,
    OtherAttributes=True,
    Axes=False,
    Labels=False,
    SymbolScale=1,
    LoadScale=1,
    Transparency=0.65)
composite_beam = CompositeBeam(Beam=super_element_filter_4, SectionStart=composite_beam_property.CompositeSection)
preview_bridghe_model_5 = PreviewBridGHeModel(ModelElements=composite_beam, Settings=display_settings_5)
super_element_check = SuperElementCheck(
    BridGHeModel=build_bridghe_model.Model,
    SuperElementBeam=composite_beam,
    WebLocalInstability=False,
    TopFlangeLocalInstability=False,
    BottomFlangeLocalInstability=False)  # -> TensionCheck, TauB, TensionForces
composite_section_linear_tension_results = CompositeSectionLinearTensionResults(LinearTensionResults=super_element_check.TensionCheck)  # -> Point1_ConcreteEpsilon, Point1_ConcreteSigma, Point2_RebarSigma, Point3_RebarSigma, Point4_ConcreteSigma, Point5_SteelSigma, Point6_SteelSigma, Point6_SteelTau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
bridge_stress_plot = BridgeStressPlot(
    BridGHeModel=build_bridghe_model.Model,
    SuperElementBeam=composite_beam,
    Results=super_element_check.TensionCheck,
    Quantity=3,
    ShowMinMaxCombo=True,
    FilePath="C:\Temp\diagramma.png",
    KeepRunning=False)  # -> SVG, File, Minimum, Maximum
bridge_force_plot = BridgeForcePlot(
    BridGHeModel=build_bridghe_model.Model,
    SuperElementBeam=composite_beam,
    Results=super_element_check.TensionForces,
    Quantity=4,
    ShowMinMaxCombo=True,
    FilePath="C:\Temp\diagramma.png",
    KeepRunning=False)  # -> SVG, File, Minimum, Maximum
bridghe_panel = BridGHePanel()
sigma_cls_superiore_mpa = Panel(composite_section_linear_tension_results.Point1_ConcreteSigma)
sigma_armatura_superiore_mpa = Panel(composite_section_linear_tension_results.Point2_RebarSigma)
sigma_armatura_inferiore_mpa = Panel(composite_section_linear_tension_results.Point3_RebarSigma)
sigma_acciaio_inferiore_mpa = Panel(composite_section_linear_tension_results.Point8_SteelSigma)
bridge_plot_preview = BridgePlotPreview(SVG=flatten(bridge_stress_plot.SVG), Index=0, Width=600)
bridge_plot_preview_2 = BridgePlotPreview(SVG=flatten(bridge_force_plot.SVG), Index=0, Width=600)
intermedi_200x20_pannelli2m = BridgeIntermediateStiffener(
    Enabled=True,
    Layout=0,
    Width=200,
    Thickness=20,
    RightWidth=200,
    RightThickness=20,
    LeftPanel=2000,
    RightPanel=4000,
    EqualPanels=True,
    LengthFactor=1,
    ExternalCompressionKN=0,
    LoadX=0,
    CheckWelds=True,
    WeldThroat=6)
pioli_2x22_passo200 = BridgeStuds(
    Enabled=True,
    CountPerRow=2,
    Diameter=22,
    Height=180,
    LongitudinalPitch=200,
    TransversePitch=150,
    Fu=450,
    GammaV=1.25,
    HeadDiameter=35,
    HeadThickness=10,
    RequiredCover=40,
    RepeatedActionDetail=True)
appoggio_r900kn_assegnato = BridgeSupportStiffener(
    Enabled=True,
    Layout=0,
    Width=200,
    Thickness=25,
    RightWidth=250,
    RightThickness=25,
    Location=0,
    LeftPanel=2000,
    RightPanel=2000,
    ReactionKN=900,
    EndDistance=250,
    LoadX=0,
    LoadZ=0,
    FootprintLength=400,
    FootprintWidth=600,
    LengthFactor=1,
    RigidEndPost=False,
    EndPostSpacing=300,
    CheckWelds=True,
    WeldThroat=10)
value_list_14 = ValueList({"Completa": 0, "Trave e stazione": 1, "Combinazione": 2, "Fase": 3}, selected="Completa")
ultimate_solo_dimostrazione = BridgeAnalysisOptions(
    Standard=1,
    LimitState=0,
    Class4=True,
    TopFlangeBuckling=True,
    BottomFlangeBuckling=True,
    WebBuckling=True,
    CommonLoadY=0,
    GammaM0=1.05,
    GammaM1=1.1,
    GammaM2=1.25,
    GammaC=1.5,
    GammaS=1.15,
    AlphaCC=0.85,
    ShearEta=1.2)
_3_dettagli_sulle_stesse_azioni = BridgeDetailCheck(
    SectionResult=super_element_check.TensionCheck,
    Studs=pioli_2x22_passo200,
    IntermediateStiffener=intermedi_200x20_pannelli2m,
    SupportStiffener=appoggio_r900kn_assegnato,
    Options=ultimate_solo_dimostrazione)  # -> SectionResult, Check, Demand, Resistance, Units, Ratio, Status, Warnings
bridge_result_labels = BridgeResultLabels(Results=_3_dettagli_sulle_stesse_azioni.SectionResult, Format=value_list_14)
pioli_per_stazione_e_combo = BridgeStudResults(SectionResult=_3_dettagli_sulle_stesse_azioni.SectionResult)  # -> ConnectionFlow, ForcePerStud, ResistancePerStud, ResistancePerLength, ForceRatio, Phase, PhaseFlow, Warnings
tutti_gli_esiti_locali = BridgeCheckSummary(Results=_3_dettagli_sulle_stesse_azioni.SectionResult, Labels=bridge_result_labels)  # -> Label, Phase, Check, Ratio, Status, Units, Notes, MaximumFiniteRatio, UnavailableRatios, GoverningLabels
flusso_n_mm = Panel(pioli_per_stazione_e_combo.ConnectionFlow)
forza_per_piolo_kn = Panel(pioli_per_stazione_e_combo.ForcePerStud)
# PERCORSO E LIMITI: Tension Check contiene BridgeStressResult, non soltanto tensioni. Conservare l'albero {indice beam;indice stazione}; gli item sono le combinazioni.
# Details di Layout è una lista di definizioni geometriche: non collegarla indiscriminatamente a Results. Suddividere le zone e associare il dettaglio alla sua stazione.
# Calculation=1 LinearHistory NON è supportato da Detail Check. L'opzione Ultimate non genera coefficienti né altera le azioni FEM.
# Per appoggi reali usare la reazione compressiva corretta, con unità e associazione di combinazione coerenti. R=900 in questo file è dimostrativa.
rapporto_piolo = Panel(pioli_per_stazione_e_combo.ForceRatio)
controlli = Panel(_3_dettagli_sulle_stesse_azioni.Check)
riepilogo_controllo_governante_per_stazi = Panel(tutti_gli_esiti_locali.GoverningLabels)  # "Riepilogo — controllo governante per stazione"
rapporti_stesso_ordine = Panel(_3_dettagli_sulle_stesse_azioni.Ratio)

# ==== cluster Cluster
radius = ClusterInput()
A = ClusterInput()
B = ClusterInput()
circle = Circle(Plane=PlaneXY(0, 0, 0), Radius=expr("x/2", radius))
division = Division(A=A, B=B)
multiplication = Multiplication(A=division, B=0.1)
area = Area(Geometry=circle)  # -> Area, Centroid
multiplication_2 = Multiplication(A=area.Area, B=multiplication)
result = ClusterOutput(multiplication_2)
